# Grasshopper definition grasshopper_non-blcoking-socket_example_b.gh (Grasshopper 1.0.7)

trigger = BooleanToggle(False)
number_slider = Slider(0.6, range=0.1..2)
number_slider_2 = Slider(0.1, range=0.1..2)
number_slider_3 = Slider(0.6, range=0.1..2)
number_slider_4 = Slider(3, range=0..100)
number_slider_5 = Slider(0.2, range=0.1..2)
number_slider_6 = Slider(22, range=0..100)
# {'param_definitions': None, 'instance_guid': 'aac13f3a-2ff8-466f-ae4b-890bd19ddd72', 'code': 'import Rhino.Geometry as rg\n\n# Get input parameters\nradius = float(x)\nheight = float(y)\n\n# Create a cylinder\ncylinder = rg.Cylinder(rg.Circle(rg.Point3d(0, 0, 0), radius), height)\nbrep = cylinder.ToBrep(True, True)\n\n# Create a sphere on top\nsphere = rg.Sphere(rg.Point3d(0, 0, height), radius * 0.8)\nsphere_brep = sphere.ToBrep()\n\n# Output the geometry\na = [brep, sphere_brep]', 'description': None, 'message_to_user': "I've created a simple parametric structure with a cylinder and sphere. The 'x' slider controls the radius, and the 'y' slider controls the height.", 'type': 'update_script'}
mcp_socket = GhPythonScript(start_server=trigger)  # disabled
# ---------- mcp_socket: Python ----------
import scriptcontext as sc
import clr, socket, threading, Rhino, json
clr.AddReference("System")
clr.AddReference("System.Drawing")
clr.AddReference("Grasshopper")
from System import Action
from System.Drawing import RectangleF
import Grasshopper
import Rhino.Geometry as rg

class GHEncoder(json.JSONEncoder):
    """Custom JSON encoder for Grasshopper/Rhino types"""
    def default(self, obj):
        if isinstance(obj, rg.Point3d):
            return {
                "x": float(obj.X),
                "y": float(obj.Y),
                "z": float(obj.Z)
            }
        elif isinstance(obj, RectangleF):
            return {
                "x": float(obj.X),
                "y": float(obj.Y),
                "width": float(obj.Width),
                "height": float(obj.Height)
            }
        return json.JSONEncoder.default(self, obj)

# Use scriptcontext.sticky as a persistent dictionary.
if "command" not in sc.sticky:
    sc.sticky["command"] = None
if "server_running" not in sc.sticky:
    sc.sticky["server_running"] = False
if "last_result" not in sc.sticky:
    sc.sticky["last_result"] = None
if "server_thread" not in sc.sticky:
    sc.sticky["server_thread"] = None


def get_param_info(param, parent_component=None):
    """Get information about a Grasshopper parameter."""
    try:
        bounds_rect = RectangleF(
            param.Attributes.Bounds.X, 
            (param.Attributes.Bounds.Y * -1) - param.Attributes.Bounds.Height, 
            param.Attributes.Bounds.Width, 
            param.Attributes.Bounds.Height
        )
        pivot_pt = rg.Point3d(param.Attributes.Pivot.X, param.Attributes.Pivot.Y * -1, 0)
        
        param_info = {
            "instanceGuid": str(param.InstanceGuid),
            "componentGuid": str(parent_component) if parent_component else None,
            "bounds": bounds_rect,
            "pivot": pivot_pt,
            "dataMapping": str(param.DataMapping) if hasattr(param, 'DataMapping') else None,
            "dataType": str(param.TypeName) if hasattr(param, 'TypeName') else None,
            "simplify": str(param.Simplify) if hasattr(param, 'Simplify') else None,
            "computiationTime": float(param.ProcessorTime.Milliseconds),
            "name": param.Name,
            "nickName": param.NickName,
            "category": param.Category,
            "subCategory": param.SubCategory,
            "description": param.Description,
            "kind": str(param.Kind) if hasattr(param, 'Kind') else None,
            "dataCount": param.VolatileData.DataCount if hasattr(param, 'VolatileData') else None,
            "pathCount": param.VolatileData.PathCount if hasattr(param, 'VolatileData') else None,
            "sources": [],
            "targets": []
        }

        # Get sources (inputs)
        for src in param.Sources:
            try:
                param_info["sources"].append(str(src.InstanceGuid))
            except:
                pass

        # Get targets (outputs)
        for tgt in param.Recipients:
            try:
                param_info["targets"].append(str(tgt.InstanceGuid))
            except:
                pass

        return param_info
    except Exception as e:
        print("Error getting param info: " + str(e))
        return None

def get_grasshopper_context():
    """Get information about the current Grasshopper document and its components."""
    try:
        # Get the current Grasshopper document
        doc = ghenv.Component.OnPingDocument()
        if not doc:
            return {"error": "No active Grasshopper document"}

        # Initialize graph dictionary
        IO_graph = {}

        # Get all objects in the document
        for obj in doc.Objects:
            if isinstance(obj, Grasshopper.Kernel.IGH_Component):
                comp_instanceGuid = str(obj.InstanceGuid)
                comp_out = obj.Params.Output
                comp_in = obj.Params.Input
                
                # Get component kind with fallback
                try:
                    kind = str(obj.Kind) if hasattr(obj, 'Kind') else str(obj.__class__.__name__)
                except:
                    kind = str(obj.__class__.__name__)
                
                # Basic info for all components
                comp_info = {
                    "instanceGuid": comp_instanceGuid,
                    "name": obj.Name,
                    "nickName": obj.NickName,
                    "description": obj.Description,
                    "category": obj.Category,
                    "subCategory": obj.SubCategory,
                    "kind": kind,
                    "sources": [],
                    "targets": []
                }
                
                # Add additional info for non-standard components
                if kind != "component":
                    comp_info.update({
                        "componentGuid": None,
                        "bounds": RectangleF(
                            obj.Attributes.Bounds.X, 
                            (obj.Attributes.Bounds.Y * -1) - obj.Attributes.Bounds.Height, 
                            obj.Attributes.Bounds.Width, 
                            obj.Attributes.Bounds.Height
                        ),
                        "pivot": rg.Point3d(obj.Attributes.Pivot.X, obj.Attributes.Pivot.Y * -1, 0),
                        "dataMapping": None,
                        "dataType": None,
                        "simplify": None,
                        "computiationTime": float(obj.ProcessorTime.Milliseconds),
                        "dataCount": None,
                        "pathCount": None
                    })
                
                IO_graph[comp_instanceGuid] = comp_info

                # Process outputs
                for o in comp_out:
                    param_info = get_param_info(o, comp_instanceGuid)
                    if param_info:
                        IO_graph[param_info["instanceGuid"]] = param_info

                # Process inputs
                for o in comp_in:
                    param_info = get_param_info(o, comp_instanceGuid)
                    if param_info:
                        if comp_instanceGuid not in param_info["targets"]:
                            param_info["targets"].append(comp_instanceGuid)
                        IO_graph[param_info["instanceGuid"]] = param_info

            elif isinstance(obj, Grasshopper.Kernel.IGH_Param):
                param_info = get_param_info(obj)
                if param_info:
                    IO_graph[param_info["instanceGuid"]] = param_info

        # Fill in sources based on targets
        for node_id, node in IO_graph.items():
            for target_id in node["targets"]:
                if target_id in IO_graph and node_id not in IO_graph[target_id]["sources"]:
                    IO_graph[target_id]["sources"].append(node_id)

        return {
            "status": "success",
            "graph": IO_graph
        }
    except Exception as e:
        print("Error in get_grasshopper_context: " + str(e))
        return {"error": str(e)}

def receive_full_request(conn):
    """Receive the complete HTTP request."""
    data = b''
    while True:
        chunk = conn.recv(4096)
        if not chunk:
            break
        data += chunk
        if b'\r\n\r\n' in data:  # Found end of headers
            break
    return data.decode('utf-8')

def respond(conn, response_dict):
    """Send an HTTP response with JSON content and close the connection."""
    json_response = json.dumps(response_dict, cls=GHEncoder)
    http_response = (
        "HTTP/1.1 200 OK\r\n"
        "Content-Type: application/json\r\n"
        "Content-Length: {}\r\n"
        "Access-Control-Allow-Origin: *\r\n"
        "Connection: close\r\n"
        "\r\n"
        "{}"
    ).format(len(json_response), json_response)
    try:
        conn.sendall(http_response.encode('utf-8'))
    finally:
        try:
            conn.shutdown(socket.SHUT_RDWR)
        except:
            pass

def parse_command(data):
    """Parse the incoming command data into a structured format."""
    try:
        command_data = json.loads(data)
        if isinstance(command_data, dict):
            return command_data
        return {"type": "raw", "data": data}
    except json.JSONDecodeError:
        return {"type": "raw", "data": data}

def execute_code(code_str):
    """Execute Python code string and return the result."""
    try:
        # Create a new dictionary for local variables
        local_vars = {}
        
        # Execute the code with access to the current context
        exec(code_str, globals(), local_vars)
        
        # If there's a result variable defined, return it
        if 'result' in local_vars:
            return {"status": "success", "result": local_vars['result']}
        return {"status": "success", "result": "Code executed successfully"}
    except Exception as e:
        print("Code execution error: " + str(e))
        return {"status": "error", "result": str(e)}

def process_command(command_data):
    """Process a command and return the result."""
    command_type = command_data.get("type", "raw")
    if command_type == "raw":
        # Handle legacy raw text commands
        raw_data = command_data["data"]
        if raw_data == "fetch_new_data":
            return {"result": "Fetched new data!", "status": "success"}
        else:
            return {"result": "Unknown command: " + raw_data, "status": "error"}
    elif command_type == "test_command":
        # Handle test command with dummy response
        params = command_data.get("params", {})
        return {
            "status": "success",
            "result": {
                "message": "Test command executed successfully",
                "received_params": params,
                "dummy_data": {"value": 42, "text": "Hello from Grasshopper!"}
            }
        }
    elif command_type == "get_context":
        # Get Grasshopper context
        context = get_grasshopper_context()
        if "error" in context:
            return {"status": "error", "result": context}
        return {
            "status": "success",
            "result": context
        }
    elif command_type == "execute_code":
        # Execute Python code
        code = command_data.get("code", "")
        if not code:
            return {"status": "error", "result": "No code provided"}
        return execute_code(code)
    else:
        return {"result": "Unknown command type: " + command_type, "status": "error"}

def socket_server():
    s = socket.socket(socket.AF_INET, socket.SOCK_STREAM)
    s.setsockopt(socket.SOL_SOCKET, socket.SO_REUSEADDR, 1)
    host = "127.0.0.1"  # Bind to localhost
    port = 9999         # Use port 9999
    s.bind((host, port))
    s.listen(5)         # Allow up to 5 pending connections
    print("Socket server listening on {}:{}".format(host, port))
    A = "Socket server listening on 127.0.0.1:9999"
    
    while True:
        try:
            s.settimeout(1.0)  # Check for new connections every second.
            try:
                conn, addr = s.accept()
                conn.settimeout(5.0)  # Set timeout for receiving data
            except socket.timeout:
                continue
            
            try:
                full_data = receive_full_request(conn)
                if not full_data:
                    continue
                
                # Extract the payload from the HTTP request (ignoring headers)
                parts = full_data.split("\r\n\r\n")
                if len(parts) > 1:
                    command = parts[1].strip()
                else:
                    command = full_data.strip()
                
                # Parse the command into a structured format
                command_data = parse_command(command)
                print("Received command: " + str(command_data))

                # Handle stop command
                if command_data.get("type") == "stop":
                    print("Received stop command. Closing server.")
                    respond(conn, {"status": "stopping", "message": "Server is shutting down."})
                    conn.close()
                    break

                # Process command immediately and store result
                result = process_command(command_data)
                sc.sticky["last_result"] = result
                
                # Send response with result
                response = {
                    "status": result["status"],
                    "result": result["result"],
                    "command_type": command_data.get("type", "raw")
                }
                respond(conn, response)
            except Exception as e:
                print("Error handling request: " + str(e))
                error_response = {
                    "status": "error",
                    "result": str(e),
                    "command_type": "error"
                }
                respond(conn, error_response)
            finally:
                try:
                    conn.close()
                except:
                    pass
        except Exception as e:
            print("Socket server error: " + str(e))
            break
    s.close()
    sc.sticky["server_running"] = False
    print("Socket server closed.")

# Start the socket server if it isn't already running.
if not sc.sticky["server_running"]:
    sc.sticky["server_running"] = True
    thread = threading.Thread(target=socket_server)
    thread.daemon = True
    thread.start()

# Main SolveInstance processing:
if sc.sticky["last_result"]:
    result = sc.sticky["last_result"]
    sc.sticky["last_result"] = None  # Clear the result after processing
    A = "Last command result: " + json.dumps(result, cls=GHEncoder)  # Use custom encoder here too
else:
    A = "Waiting for command..."
# ---------- end mcp_socket ----------
number_slider_7 = Slider(10, range=0..100)
number_slider_8 = Slider(64, range=0..100)
ghpython_script = GhPythonScript()  # -> out, A
# ---------- ghpython_script: Python ----------
__author__ = "Joo"

import rhinoscriptsyntax as rs
import scriptcontext as sc


A = str(sc.sticky["commandData"])
# ---------- end ghpython_script ----------
test_message = GhPythonScript(testTrigger=Button())  # -> A
# ---------- test_message: Python ----------
import socket
import json
import scriptcontext as sc
import datetime

def send_test_message():
    """Send a test message to the server and return the response."""
    s = socket.socket(socket.AF_INET, socket.SOCK_STREAM)
    s.settimeout(0.5)  # Short timeout to avoid freezing Grasshopper
    try:
        s.connect(("127.0.0.1", 9999))
        # Create a test JSON payload with current time
        current_time = datetime.datetime.now().strftime("%Y-%m-%d %H:%M:%S")
        payload = json.dumps({
            "type": "test", 
            "message": "Hello Server", 
            "timestamp": current_time
        })
        # Build HTTP request
        request = (
            "POST / HTTP/1.1\r\n"
            "Host: 127.0.0.1\r\n"
            "Content-Type: application/json\r\n"
            "Content-Length: {}\r\n"
            "\r\n"
            "{}"
        ).format(len(payload), payload)
        # Send the request
        s.sendall(request.encode('utf-8'))
        # Read server response
        response = s.recv(4096)
        return response.decode('utf-8')
    except Exception as e:
        return "Test message failed or timed out: " + str(e)
    finally:
        try:
            s.close()
        except:
            pass


if "testStatus" not in sc.sticky:
    sc.sticky["testStatus"] = ""

# Handle the test message trigger - ONLY do something on True->False transition
if testTrigger == False:
    # Only now do we send the test message
    test_response = send_test_message()
    sc.sticky["testStatus"] = "Test message sent.\n\nServer response:\n" + test_response + " - time: " + datetime.datetime.now().strftime("%M:%S")



# Set output
try:
    A = sc.sticky["testStatus"]
except:
    A = ""
# ---------- end test_message ----------
last_command = GhPythonScript(testTrigger=Button())  # -> A, b, c, d
# ---------- last_command: Python ----------
import scriptcontext as sc

try:
    A = str(sc.sticky["commandData"])
except:
    A = "No data yet"
b = sc.sticky["fullData"]


# Retrieve and display debug logs
logs = []
if "debugLog" in sc.sticky:
    logs = sc.sticky["debugLog"]

try: 
    c = sc.sticky["debugLog"]
except:
    pass
try:
    d = str(sc.sticky["last_result"])
except:
    pass
# ---------- end last_command ----------
relativepath = Panel("rhino_mcp/hellow_world.py")
mcp_socket_2 = GhPythonScript(start_server=trigger)  # -> A
# ---------- mcp_socket_2: Python ----------
import scriptcontext as sc
import clr, socket, threading, Rhino, json
clr.AddReference("System")
clr.AddReference("System.Drawing")
clr.AddReference("Grasshopper")
from System import Action
from System.Drawing import RectangleF
import Grasshopper
import Grasshopper as gh
import Rhino.Geometry as rg
import System
from System import Guid
from Grasshopper.Kernel import GH_ParamAccess
from Grasshopper.Kernel.Parameters import Param_GenericObject
from Grasshopper.Kernel.Parameters import Param_String, Param_Number, Param_Integer, Param_Boolean


class GHEncoder(json.JSONEncoder):
    """Custom JSON encoder for Grasshopper/Rhino types"""
    def default(self, obj):
        if isinstance(obj, rg.Point3d):
            return {
                "x": float(obj.X),
                "y": float(obj.Y),
                "z": float(obj.Z)
            }
        elif isinstance(obj, RectangleF):
            return {
                "x": float(obj.X),
                "y": float(obj.Y),
                "width": float(obj.Width),
                "height": float(obj.Height)
            }
        return json.JSONEncoder.default(self, obj)

# Use scriptcontext.sticky as a persistent dictionary.
if "command" not in sc.sticky:
    sc.sticky["command"] = None
if "server_running" not in sc.sticky:
    sc.sticky["server_running"] = False
if "last_result" not in sc.sticky:
    sc.sticky["last_result"] = None
if "server_thread" not in sc.sticky:
    sc.sticky["server_thread"] = None


def get_param_info(param, is_input=True, parent_instance_guid=None, simplified=False, is_selected=False):
    """Collect information from a Grasshopper parameter."""
    if simplified:
        # Simplified param info with just connections
        info = {
            "instanceGuid": str(param.InstanceGuid),
            "name": param.Name,
            "sources": [],
            "targets": [],
            "isSelected": is_selected
        }
        
        # Get sources (inputs)
        if hasattr(param, "Sources"):
            for src in param.Sources:
                try:
                    info["sources"].append(str(src.InstanceGuid))
                except:
                    pass
        
        # Get targets (outputs)
        if hasattr(param, "Recipients"):
            for tgt in param.Recipients:
                try:
                    info["targets"].append(str(tgt.InstanceGuid))
                except:
                    pass
                    
        # If this is a component param, add its parent to targets or sources
        if parent_instance_guid:
            if is_input and str(parent_instance_guid) not in info["targets"]:
                info["targets"].append(str(parent_instance_guid))
            elif not is_input and str(parent_instance_guid) not in info["sources"]:
                info["sources"].append(str(parent_instance_guid))
        
        return info
    
    # Detailed param info
    try:
        bounds_rect = RectangleF(
            param.Attributes.Bounds.X, 
            (param.Attributes.Bounds.Y * -1) - param.Attributes.Bounds.Height, 
            param.Attributes.Bounds.Width, 
            param.Attributes.Bounds.Height
        )
        pivot_pt = rg.Point3d(param.Attributes.Pivot.X, param.Attributes.Pivot.Y * -1, 0)
        
        param_info = {
            "instanceGuid": str(param.InstanceGuid),
            "parentInstanceGuid": str(parent_instance_guid) if parent_instance_guid else None,
            "bounds": bounds_rect,
            "pivot": pivot_pt,
            "dataMapping": str(param.DataMapping) if hasattr(param, 'DataMapping') else None,
            "dataType": str(param.TypeName) if hasattr(param, 'TypeName') else None,
            "simplify": str(param.Simplify) if hasattr(param, 'Simplify') else None,
            "name": param.Name,
            "nickName": param.NickName,
            "category": param.Category,
            "subCategory": param.SubCategory,
            "description": param.Description,
            "kind": str(param.Kind) if hasattr(param, 'Kind') else None,
            "sources": [],
            "targets": [],
            "isSelected": is_selected
        }
        
        # Add specific input parameter properties
        if is_input:
            try:
                param_info["InputAccess"] = str(param.Access)
            except Exception as e:
                param_info["InputAccess"] = "N/A"
            try:
                param_info["dataTypeHint"] = str(param.TypeHint)
            except Exception as e:
                param_info["dataTypeHint"] = "N/A"

        # Get sources (inputs)
        for src in param.Sources:
            try:
                param_info["sources"].append(str(src.InstanceGuid))
            except:
                pass

        # Get targets (outputs)
        for tgt in param.Recipients:
            try:
                param_info["targets"].append(str(tgt.InstanceGuid))
            except:
                pass
                
        # If this is a component param, add its parent to targets or sources
        if parent_instance_guid:
            if is_input and str(parent_instance_guid) not in param_info["targets"]:
                param_info["targets"].append(str(parent_instance_guid))
            elif not is_input and str(parent_instance_guid) not in param_info["sources"]:
                param_info["sources"].append(str(parent_instance_guid))

        return param_info
    except Exception as e:
        print("Error getting param info: " + str(e))
        return None

def get_component_info(comp, simplified=False, is_selected=False):
    """Collect information from a Grasshopper component."""
    if simplified:
        # Simplified component info
        info = {
            "instanceGuid": str(comp.InstanceGuid),
            "name": comp.Name,
            "nickName": comp.NickName,
            "description": comp.Description,
            "pivot": {"X": float(comp.Attributes.Pivot.X), "Y": float(comp.Attributes.Pivot.Y)} if (hasattr(comp, "Attributes") and comp.Attributes) else {},
            "inputs": [],
            "outputs": [],
            "sources": [],
            "targets": [],
            "isSelected": is_selected
            
        }
        
        try:
            info["runTimeMessage"]= str(component.RuntimeMessages(component.RuntimeMessageLevel)).replace("List[str]","")
        except:
            pass
        # Get input and output parameter info
        if hasattr(comp, "Params"):
            if hasattr(comp.Params, "Input"):
                info["inputs"] = [get_param_info(p, is_input=True, parent_instance_guid=comp.InstanceGuid, simplified=True) for p in comp.Params.Input]
            if hasattr(comp.Params, "Output"):
                info["outputs"] = [get_param_info(p, is_input=False, parent_instance_guid=comp.InstanceGuid, simplified=True) for p in comp.Params.Output]
        
        return info
    
    # Get component kind with fallback
    try:
        kind = str(comp.Kind) if hasattr(comp, 'Kind') else str(comp.__class__.__name__)
    except:
        kind = str(comp.__class__.__name__)
    
    # Basic info for all components
    comp_info = {
        "instanceGuid": str(comp.InstanceGuid),
        "name": comp.Name,
        "nickName": comp.NickName,
        "description": comp.Description,
        "category": comp.Category,
        "subCategory": comp.SubCategory,
        "kind": kind,
        "sources": [],
        "targets": [],
        "isSelected": is_selected
    }
    
    try:
        comp_info["runTimeMessage"]= str(component.RuntimeMessages(component.RuntimeMessageLevel)).replace("List[str]","")
    except:
        pass
    # Add additional info for non-standard components
    if kind != "component":
        comp_info.update({
            "bounds": RectangleF(
                comp.Attributes.Bounds.X, 
                (comp.Attributes.Bounds.Y * -1) - comp.Attributes.Bounds.Height, 
                comp.Attributes.Bounds.Width, 
                comp.Attributes.Bounds.Height
            ),
            "pivot": rg.Point3d(comp.Attributes.Pivot.X, comp.Attributes.Pivot.Y * -1, 0),
            "dataMapping": None,
            "dataType": None,
            "simplify": None,
            "computiationTime": float(comp.ProcessorTime.Milliseconds),
            "dataCount": None,
            "pathCount": None
        })
    
    # If the component is a script component, add its code.
    if comp.SubCategory == "Script":
        if hasattr(comp, "Code"):
            comp_info["Code"] = comp.Code
            #checks if code 
            comp_info["codeReferenceFromFile"] = comp.InputIsPath
            # if so check if we can get the file path
            if comp.InputIsPath:
                try:
                    for p in comp.Params.Input:
                        if p.Name == "code" and p.VolatileDataCount > 0:
                            comp_info["codeReferencePath"] = str(p.VolatileData.get_DataItem(0))
                            break
                except:
                    pass
        else:
            comp_info["Code"] = "none"
    
    # Get input and output parameter info if available.
    if hasattr(comp, "Params"):
        if hasattr(comp.Params, "Input"):
            comp_info["Inputs"] = [get_param_info(p, is_input=True, parent_instance_guid=comp.InstanceGuid) for p in comp.Params.Input]
        if hasattr(comp.Params, "Output"):
            comp_info["Outputs"] = [get_param_info(p, is_input=False, parent_instance_guid=comp.InstanceGuid) for p in comp.Params.Output]
    
    return comp_info

def get_standalone_param_info(param, simplified=False, is_selected=False):
    """Collect information for standalone parameters (sliders, panels, etc.)"""
    return get_param_info(param, is_input=False, simplified=simplified, is_selected=is_selected)

def sort_graph_by_execution_order(graph):
    """
    Sort the graph dictionary by component execution order.
    
    Args:
        graph: The graph dictionary containing component and parameter information
    
    Returns:
        A new graph dictionary with keys ordered by execution sequence
    """
    # Create a dictionary to store in-degrees (number of incoming edges)
    in_degree = {node_id: 0 for node_id in graph}
    
    # Calculate in-degree for each node
    for node_id, node_info in graph.items():
        if "targets" in node_info:
            for target_id in node_info["targets"]:
                if target_id in in_degree:
                    in_degree[target_id] += 1
    
    # Queue with nodes that have no incoming edges (in-degree = 0)
    queue = [node_id for node_id, degree in in_degree.items() if degree == 0]
    
    # List to store the sorted order
    sorted_order = []
    
    # Process nodes in the queue
    while queue:
        # Get the next node
        current_id = queue.pop(0)
        sorted_order.append(current_id)
        
        # Reduce in-degree of all targets (downstream components)
        if "targets" in graph[current_id]:
            for target_id in graph[current_id]["targets"]:
                if target_id in in_degree:
                    in_degree[target_id] -= 1
                    # If in-degree becomes 0, add to queue
                    if in_degree[target_id] == 0:
                        queue.append(target_id)
    
    # For any remaining nodes (cycles or unreachable), add to the end
    remaining_nodes = [node_id for node_id in graph if node_id not in sorted_order]
    sorted_order.extend(remaining_nodes)
    
    # Create a new ordered dictionary
    ordered_graph = {}
    for node_id in sorted_order:
        if node_id in graph:
            ordered_graph[node_id] = graph[node_id]
    
    return ordered_graph

def get_objects(instance_guids, context_depth=0, simplified=False):
    """
    Get Grasshopper objects by their instance GUIDs with optional context.
    
    Args:
        instance_guids: Single GUID or list of instance GUIDs to retrieve
        context_depth: How many levels up/downstream to include (0-3)
        simplified: Whether to return simplified object info
    
    Returns:
        Dictionary of found objects, keyed by their instance GUID
    """
    # Get the current Grasshopper document
    doc = ghenv.Component.OnPingDocument()
    if not doc:
        return {}
    
    # Handle single GUID case
    if not isinstance(instance_guids, list):
        instance_guids = [instance_guids]
    
    # Convert string GUIDs to System.Guid if needed
    instance_guid_map = {}
    for guid in instance_guids:
        if isinstance(guid, str):
            try:
                import System
                instance_guid_map[System.Guid(guid)] = guid
            except:
                instance_guid_map[guid] = guid
        else:
            instance_guid_map[guid] = guid
    
    # Find objects with the given instance GUIDs
    result = {}
    selected_guids = set()
    
    for obj in doc.Objects:
        if obj.InstanceGuid in instance_guid_map:
            guid_str = str(instance_guid_map[obj.InstanceGuid])
            selected_guids.add(guid_str)
            
            if isinstance(obj, Grasshopper.Kernel.IGH_Component):
                result[guid_str] = get_component_info(obj, simplified=simplified, is_selected=True)
            elif isinstance(obj, Grasshopper.Kernel.IGH_Param):
                result[guid_str] = get_standalone_param_info(obj, simplified=simplified, is_selected=True)
            else:
                result[guid_str] = {"instanceGuid": guid_str, "isSelected": True}
    
    # If context depth is requested, traverse the graph to find related objects
    if context_depth > 0 and result and context_depth <= 3:  # Limit to max depth of 3
        # First build a complete graph to work with
        graph = {}
        for obj in doc.Objects:
            guid_str = str(obj.InstanceGuid)
            
            if isinstance(obj, Grasshopper.Kernel.IGH_Component):
                graph[guid_str] = {"sources": [], "targets": []}
                # Add sources from input params
                if hasattr(obj, "Params") and hasattr(obj.Params, "Input"):
                    for param in obj.Params.Input:
                        for src in param.Sources:
                            graph[guid_str]["sources"].append(str(src.InstanceGuid))
                
                # Add targets from output params
                if hasattr(obj, "Params") and hasattr(obj.Params, "Output"):
                    for param in obj.Params.Output:
                        for tgt in param.Recipients:
                            graph[guid_str]["targets"].append(str(tgt.InstanceGuid))
            
            elif isinstance(obj, Grasshopper.Kernel.IGH_Param):
                graph[guid_str] = {"sources": [], "targets": []}
                # Add sources
                if hasattr(obj, "Sources"):
                    for src in obj.Sources:
                        graph[guid_str]["sources"].append(str(src.InstanceGuid))
                
                # Add targets
                if hasattr(obj, "Recipients"):
                    for tgt in obj.Recipients:
                        graph[guid_str]["targets"].append(str(tgt.InstanceGuid))
        
        # Traverse both upstream and downstream
        context_guids = set()
        current_level = set(selected_guids)
        
        for depth in range(context_depth):
            next_level = set()
            
            for guid in current_level:
                if guid in graph:
                    # Add upstream (sources)
                    for src in graph[guid]["sources"]:
                        if src not in selected_guids and src not in context_guids:
                            next_level.add(src)
                            context_guids.add(src)
                    
                    # Add downstream (targets)
                    for tgt in graph[guid]["targets"]:
                        if tgt not in selected_guids and tgt not in context_guids:
                            next_level.add(tgt)
                            context_guids.add(tgt)
            
            current_level = next_level
            if not current_level:
                break  # No more objects to add
        
        # Add context objects to result
        for guid in context_guids:
            obj = get_object_by_instance_guid(doc, guid)
            if obj:
                if isinstance(obj, Grasshopper.Kernel.IGH_Component):
                    result[guid] = get_component_info(obj, simplified=simplified, is_selected=False)
                elif isinstance(obj, Grasshopper.Kernel.IGH_Param):
                    result[guid] = get_standalone_param_info(obj, simplified=simplified, is_selected=False)
    
    # Always sort the dictionary by execution order for consistency
    if result:
        result = sort_graph_by_execution_order(result)
    
    # For single object requests, if we found it, return just that object's info
    if len(instance_guids) == 1 and len(result) == 1 and context_depth == 0:
        return result.values()[0]
    
    return result

def get_object_by_instance_guid(doc, instance_guid):
    """
    Helper function to get an object from document by instance GUID string.
    
    Args:
        doc: Grasshopper document
        instance_guid: Instance GUID string
    
    Returns:
        Grasshopper object if found, None otherwise
    """
    try:
        import System
        if isinstance(instance_guid, str):
            instance_guid = System.Guid(instance_guid)
        
        for obj in doc.Objects:
            if obj.InstanceGuid == instance_guid:
                return obj
    except:
        pass
    
    return None
    
# ======== edit code component 


def update_script_component(instance_guid, code=None, description=None, message_to_user=None, param_definitions=None):
    """
    Updates a script component identified by its GUID with new code, description,
    a user message, and optionally new input/output parameters.
    
    Args:
        instance_guid (str): The GUID of the target script component.
        code (str, optional): New code for the component.
        description (str, optional): New component description.
        message_to_user (str, optional): Message to set on an output parameter.
        param_definitions (list of dict, optional): List of dictionaries defining parameters.
            Each dictionary must have:
              - "type": "input" or "output"
              - "name": a string
            Optional keys for inputs:
              - "access": "item", "list", or "tree" (default "list")
              - "typehint": e.g. "str", "int", "float", "bool" (determines parameter type)
              - "description": text to display for the parameter (falls back to default_description)
              - "optional": bool, default True
              - "default": a default value (not set persistently)
    
    Returns:
        dict: Status and result details.
    """
    default_description="Dynamically added parameter"
    # always set mesage_to_user as output
    #code = code + "\n\n# Display message to user\noutput = " + repr(message_to_user)
    try:
        # Get the Grasshopper document and find the target component by instance GUID.
        doc = ghenv.Component.OnPingDocument()
        target_instance_guid = Guid.Parse(instance_guid)
        comp = doc.FindObject(target_instance_guid, False)
        if comp is None:
            return {"status": "error", "result": "Component with instance GUID {} not found.".format(instance_guid)}
        
        
        gh.Instances.ActiveCanvas.Enabled = False

        try:
            # If parameter definitions are provided, update parameters.
            if param_definitions is not None:
                try:
                    # Step 1: Add temporary dummy parameters to prevent crashes
                    dummy_input = create_input_param({"description": "Temporary parameter"}, "__dummy_input__", default_description)
                    dummy_output = create_output_param({"description": "Temporary parameter"}, "__dummy_output__")
                    
                    comp.Params.RegisterInputParam(dummy_input)
                    comp.Params.RegisterOutputParam(dummy_output)
                    
                    # Step 2: Clear existing inputs and outputs (except dummies)
                    for p in list(comp.Params.Input):
                        if p.Name != "__dummy_input__":
                            comp.Params.UnregisterInputParameter(p)
                            
                    for p in list(comp.Params.Output):
                        if p.Name != "__dummy_output__":
                            comp.Params.UnregisterOutputParameter(p)
                    
                    # Step 3: Process and add the new parameters
                    # Process inputs
                    inputs = [d for d in param_definitions if d.get("type", "").lower() == "input"]
                    for d in inputs:
                        if "name" not in d:
                            continue
                        name = d["name"]
                        new_param = create_input_param(d, name, default_description)
                        comp.Params.RegisterInputParam(new_param)
                    
                    # Process outputs
                    outputs = [d for d in param_definitions if d.get("type", "").lower() == "output"]
                    for d in outputs:
                        if "name" not in d:
                            continue
                        name = d["name"]
                        new_param = create_output_param(d, name)
                        comp.Params.RegisterOutputParam(new_param)
                    
                    # Ensure there is always an output parameter named "output"
                    out_names = [d.get("name", "").lower() for d in outputs]
                    if "output" not in out_names:
                        default_out = create_output_param({"description": "Default output"}, "output")
                        comp.Params.RegisterOutputParam(default_out)
                    
                    # Step 4: Remove the dummy parameters now that we have real parameters
                    comp.Params.UnregisterInputParameter(dummy_input)
                    comp.Params.UnregisterOutputParameter(dummy_output)
                    
                    # Clear component data and cache
                    comp.ClearData()
                    
                except Exception as e:
                    return {"status": "error", "result": "Error updating parameters: {}".format(str(e))}
            
            # Update code if provided.
            if code is not None:
                try:
                    if hasattr(comp, "Code"):
                        comp.Code = code
                    else:
                        return {"status": "error", "result": "Component does not have a Code attribute. Component type: {}".format(type(comp).__name__)}
                except Exception as e:
                    return {"status": "error", "result": "Error updating code: {}".format(str(e))}
            
            # Update component description if provided.
            if description is not None:
                try:
                    comp.Description = description
                except Exception as e:
                    return {"status": "error", "result": "Error updating description: {}".format(str(e))}
            
            # Set a message to the user if provided (attempting to add volatile data to first output).
            if message_to_user is not None:
                try:
                    if hasattr(comp, "Params") and hasattr(comp.Params, "Output") and len(comp.Params.Output) > 0:
                        comp.Params.Output[0].AddVolatileData(Grasshopper.Kernel.Data.GH_Path(0), 0, message_to_user)
                except Exception as e:
                    return {"status": "error", "result": "Error setting message: {}".format(str(e))}
            
            # Force component to recompute.
            if hasattr(comp, "Attributes"):
                comp.Attributes.ExpireLayout()
            comp.ExpireSolution(True)
            
            return {
                "status": "success",
                "result": {
                    "code_updated": code is not None,
                    "description_updated": description is not None,
                    "message_set": message_to_user is not None,
                    "component_type": type(comp).__name__
                }
            }
        finally:
            # CRITICAL: Always unfreeze the UI, even if an error occurs
            doc.DestroyAttributeCache()
            gh.Instances.ActiveCanvas.Enabled = True

    except Exception as e:
        return {"status": "error", "result": "General error updating component: {}".format(str(e))}
        
        
def get_access(access_str):
    """
    Convert a string ("item", "list", or "tree") to GH_ParamAccess.
    Defaults to list.
    """
    if isinstance(access_str, basestring):
        s = access_str.lower()
        if s == "item":
            return GH_ParamAccess.item
        elif s == "tree":
            return GH_ParamAccess.tree
    return GH_ParamAccess.list

def create_input_param(d, name, default_description):
    """
    Creates an input parameter based on the dictionary.
    Chooses a parameter type based on 'typehint' if provided.
    Does not set the TypeHint property to keep the right-click menu active.
    """
    hint = d.get("typehint", "").lower()
    if hint in ["str", "string"]:
        param = Param_String()
    elif hint in ["int", "integer"]:
        param = Param_Integer()
    elif hint in ["float", "number", "double"]:
        param = Param_Number()
    elif hint in ["bool", "boolean"]:
        param = Param_Boolean()
    else:
        param = Param_GenericObject()
    
    param.NickName = name
    param.Name = name
    param.Description = d.get("description", default_description)
    param.Access = get_access(d.get("access", "list"))
    param.Optional = d.get("optional", True)
   
    return param

def create_output_param(d, name):
    """
    Creates an output parameter.
    For outputs, we simply create a generic parameter.
    """
    param = Param_GenericObject()
    param.NickName = name
    param.Name = name
    param.Description = d.get("description", "Dynamically added output")
    
    return param
    
    
    
def update_script_with_code_reference(instance_guid, file_path=None, param_definitions=None, description=None, name=None, force_code_reference=False):
    """
    Updates a script component to use code from an external file.
    """
    doc = ghenv.Component.OnPingDocument()
    target_guid = System.Guid.Parse(instance_guid)
    comp = doc.FindObject(target_guid, False)
    
    if comp is None:
        return {"status": "error", "result": "Component not found"}
    
    result = {"status": "error", "result": "Unknown error"}
    
    # Freeze the canvas
    gh.Instances.ActiveCanvas.Enabled = False
    
    try:
        if force_code_reference:
            # APPROACH 1: Try to completely reset the component's internal state
            
            # First, clear any existing code
            if hasattr(comp, "Code"):
                # Set component's code to a minimal script that forces external code usage
                comp.Code = "# This component is set to use external code"
            
            # Toggle InputIsPath off and on
            comp.InputIsPath = False
            comp.InputIsPath = True
            
            # Remove any existing code parameter
            for p in list(comp.Params.Input):
                if p.Name == "code":
                    comp.Params.UnregisterInputParameter(p)
            
            # Create fresh code parameter
            code_param = comp.ConstructCodeInputParameter()
            code_param.NickName = "code"
            code_param.Name = "code"
            code_param.Description = "Path to Python code file"
            
            # Force a rebuild of the component
            comp.ClearData()
            comp.Attributes.ExpireLayout()
            comp.ExpireSolution(True)
            doc.DestroyAttributeCache()
            
            # Register the parameter
            comp.Params.RegisterInputParam(code_param)
            
            # Set InputIsPath again
            comp.InputIsPath = True
            
            # Set file path if provided
            if file_path is not None:
                code_param.AddVolatileData(Grasshopper.Kernel.Data.GH_Path(0), 0, file_path)
            
            # APPROACH 2: Try manipulating document-level features to force update
            comp.Phase = Grasshopper.Kernel.GH_SolutionPhase.Blank  # Reset solution phase
            
            # Force the component to be "dirty" to ensure recomputation
            if hasattr(comp, "OnPingDocument"):
                comp_doc = comp.OnPingDocument()
                if comp_doc:
                    comp_doc.ScheduleSolution(5)  # Schedule a solution update
        
        # Handle param definitions but preserve code input
        if param_definitions is not None:
            default_description = "Dynamically added parameter"
            
            # Add temporary dummy parameters
            dummy_input = create_input_param({"description": "Temporary parameter"}, "__dummy_input__", default_description)
            dummy_output = create_output_param({"description": "Temporary parameter"}, "__dummy_output__")
            
            comp.Params.RegisterInputParam(dummy_input)
            comp.Params.RegisterOutputParam(dummy_output)
            
            # Clear existing inputs/outputs except code input and dummies
            for p in list(comp.Params.Input):
                if p.Name != "__dummy_input__" and p.Name != "code":
                    comp.Params.UnregisterInputParameter(p)
                    
            for p in list(comp.Params.Output):
                if p.Name != "__dummy_output__":
                    comp.Params.UnregisterOutputParameter(p)
            
            # Add new inputs (skip code parameter)
            inputs = [d for d in param_definitions if d.get("type", "").lower() == "input" 
                      and d.get("name", "").lower() != "code"]
            
            for d in inputs:
                if "name" not in d:
                    continue
                name_val = d["name"]
                new_param = create_input_param(d, name_val, default_description)
                comp.Params.RegisterInputParam(new_param)
            
            # Add new outputs
            outputs = [d for d in param_definitions if d.get("type", "").lower() == "output"]
            for d in outputs:
                if "name" not in d:
                    continue
                name_val = d["name"]
                new_param = create_output_param(d, name_val)
                comp.Params.RegisterOutputParam(new_param)
            
            # Ensure there's always an output parameter
            out_names = [d.get("name", "").lower() for d in outputs]
            if "output" not in out_names:
                default_out = create_output_param({"description": "Default output"}, "output")
                comp.Params.RegisterOutputParam(default_out)
            
            # Remove dummy parameters
            comp.Params.UnregisterInputParameter(dummy_input)
            comp.Params.UnregisterOutputParameter(dummy_output)
        
        # Update description and name if provided
        if description is not None:
            comp.Description = description
        
        if name is not None:
            comp.NickName = name
        
        # Final force update
        comp.ClearData()
        comp.Attributes.ExpireLayout()
        comp.ExpireSolution(True)
        
        result = {
            "status": "success",
            "result": {
                "code_reference_enforced": force_code_reference,
                "file_path_set": file_path is not None,
                "description_updated": description is not None,
                "name_updated": name is not None
            }
        }
    except Exception as e:
        result = {"status": "error", "result": str(e) + " remember in case of erros/bugs in code you need to fix it in the reference python file "}
    finally:
        # Always unfreeze the UI
        doc.DestroyAttributeCache()
        gh.Instances.ActiveCanvas.Enabled = True
    
    return result
    

#======

def get_selected_components(simplified=False, context_depth=0):
    """
    Get currently selected components and parameters in the Grasshopper document.
    
    Args:
        simplified: Whether to return simplified object info
        context_depth: How many levels up/downstream to include (0-3)
    
    Returns:
        Dictionary of selected objects, keyed by their instance GUID
    """
    # Get the current Grasshopper document
    doc = ghenv.Component.OnPingDocument()
    if not doc:
        return {"error": "No active Grasshopper document"}
    
    # Find all selected objects
    selected_guids = []
    for obj in doc.Objects:
        if hasattr(obj, "Attributes") and hasattr(obj.Attributes, "Selected") and obj.Attributes.Selected:
            selected_guids.append(str(obj.InstanceGuid))
    
    # If no objects are selected, return empty result
    if not selected_guids:
        return {}
    
    # Use the existing get_objects function to get details about the selected objects
    # This also handles the context_depth parameter
    result = get_objects(selected_guids, context_depth=context_depth, simplified=simplified)
    
    return result

def get_grasshopper_context(simplified=False):
    """
    Get information about the current Grasshopper document and its components.
    
    Args:
        simplified: Whether to return simplified graph info
    
    Returns:
        Dictionary with graph information, always sorted by execution order
    """
    try:
        # Get the current Grasshopper document
        doc = ghenv.Component.OnPingDocument()
        if not doc:
            return {"error": "No active Grasshopper document"}

        # Initialize graph dictionary
        IO_graph = {}

        # Get all objects in the document
        for obj in doc.Objects:
            is_selected = hasattr(obj, "Attributes") and hasattr(obj.Attributes, "Selected") and obj.Attributes.Selected
            
            if isinstance(obj, Grasshopper.Kernel.IGH_Component):
                comp_info = get_component_info(obj, simplified=simplified, is_selected=is_selected)
                IO_graph[str(obj.InstanceGuid)] = comp_info
            elif isinstance(obj, Grasshopper.Kernel.IGH_Param):
                # Handle standalone parameters
                param_info = get_standalone_param_info(obj, simplified=simplified, is_selected=is_selected)
                IO_graph[str(obj.InstanceGuid)] = param_info

        # Fill in sources based on targets for comprehensive connections
        for node_id, node in IO_graph.items():
            for target_id in node["targets"]:
                if target_id in IO_graph and node_id not in IO_graph[target_id]["sources"]:
                    IO_graph[target_id]["sources"].append(node_id)

        # Always sort the graph by execution order
        if IO_graph:
            IO_graph = sort_graph_by_execution_order(IO_graph)

        return {
            "status": "success",
            "graph": IO_graph
        }
    except Exception as e:
        print("Error in get_grasshopper_context: " + str(e))
        return {"error": str(e)}

def receive_full_request(conn):
    """Receive the complete HTTP request."""
    data = b''
    while True:
        chunk = conn.recv(1048576)
        if not chunk:
            break
        data += chunk
        if b'\r\n\r\n' in data:  # Found end of headers
            break
    return data.decode('utf-8')

def respond(conn, response_dict):
    """Send an HTTP response with JSON content and close the connection."""
    json_response = json.dumps(response_dict, cls=GHEncoder)
    http_response = (
        "HTTP/1.1 200 OK\r\n"
        "Content-Type: application/json\r\n"
        "Content-Length: {}\r\n"
        "Access-Control-Allow-Origin: *\r\n"
        "Connection: close\r\n"
        "\r\n"
        "{}"
    ).format(len(json_response), json_response)
    try:
        conn.sendall(http_response.encode('utf-8'))
    finally:
        try:
            conn.shutdown(socket.SHUT_RDWR)
        except:
            pass

def parse_command(data):
    """Parse the incoming command data into a structured format."""
    try:
        command_data = json.loads(data)
        if isinstance(command_data, dict):
            return command_data
        return {"type": "raw", "data": data}
    except json.JSONDecodeError:
        return {"type": "raw", "data": data}

def execute_code(code_str):
    """Execute Python code string and return the result."""
    try:
        # Create a new dictionary for local variables
        local_vars = {}
        
        # Execute the code with access to the current context
        exec(code_str, globals(), local_vars)
        
        # If there's a result variable defined, return it
        if 'result' in local_vars:
            return {"status": "success", "result": local_vars['result']}
        return {"status": "success", "result": "Code executed successfully"}
    except Exception as e:
        print("Code execution error: " + str(e))
        return {"status": "error", "result": str(e)}

def process_command(command_data):
    """Process a command and return the result."""
    command_type = command_data.get("type", "raw")
    
    if command_type == "raw":
        # Handle legacy raw text commands
        raw_data = command_data["data"]
        if raw_data == "fetch_new_data":
            return {"result": "Fetched new data!", "status": "success"}
        else:
            return {"result": "Unknown command: " + raw_data, "status": "error"}
            
    elif command_type == "test_command":
        # Handle test command with dummy response
        params = command_data.get("params", {})
        return {
            "status": "success",
            "result": {
                "message": "Test command executed successfully",
                "received_params": params,
                "dummy_data": {"value": 42, "text": "Hello from Grasshopper!"}
            }
        }
        
    elif command_type == "get_context":
        # Get Grasshopper context, with option for simplified view
        simplified = command_data.get("simplified", False)
        context = get_grasshopper_context(simplified=simplified)
        if "error" in context:
            return {"status": "error", "result": context}
        return {
            "status": "success",
            "result": context
        }
        
    elif command_type == "get_object" or command_type == "get_objects":
        # Get objects by instance GUIDs with optional context depth
        if command_type == "get_object":
            instance_guid = command_data.get("instance_guid")
            if not instance_guid:
                return {"status": "error", "result": "No instance GUID provided"}
            instance_guids = [instance_guid]
        else:
            instance_guids = command_data.get("instance_guids", [])
            if not instance_guids:
                return {"status": "error", "result": "No instance GUIDs provided"}
            
        simplified = command_data.get("simplified", False)
        context_depth = command_data.get("context_depth", 0)
        
        # Validate context_depth (0-3)
        try:
            context_depth = int(context_depth)
            if context_depth < 0:
                context_depth = 0
            elif context_depth > 3:
                context_depth = 3
        except:
            context_depth = 0
            
        result = get_objects(instance_guids, context_depth=context_depth, simplified=simplified)
        
        if not result:
            return {"status": "error", "result": "Objects not found"}
            
        return {
            "status": "success",
            "result": result
        }
        
    elif command_type == "get_selected":
        # Get selected components/parameters with optional context
        simplified = command_data.get("simplified", False)
        context_depth = command_data.get("context_depth", 0)
        
        # Validate context_depth (0-3)
        try:
            context_depth = int(context_depth)
            if context_depth < 0:
                context_depth = 0
            elif context_depth > 3:
                context_depth = 3
        except:
            context_depth = 0
            
        selected = get_selected_components(simplified=simplified, context_depth=context_depth)
        return {
            "status": "success",
            "result": selected
        }
        
    elif command_type == "update_script":
        # Update a script component (now also accepting param_definitions)
        # Accept either instance_guid or component_guid (for backward compatibility)
        instance_guid = command_data.get("instance_guid")
        if not instance_guid:
            # Fall back to component_guid if instance_guid is not provided
            instance_guid = command_data.get("component_guid")
            if not instance_guid:
                return {"status": "error", "result": "No instance_guid provided"}
        
        code = command_data.get("code")
        description = command_data.get("description")
        message_to_user = command_data.get("message_to_user")
        # New: Get dynamic parameter definitions if supplied.
        param_definitions = command_data.get("param_definitions")
        
        result = update_script_component(
            instance_guid, 
            code=code, 
            description=description, 
            message_to_user=message_to_user,
            param_definitions=param_definitions  
        )
        
        return result
        
    elif command_type == "update_script_with_code_reference":
        # Update a script component to use code from an external file
        # Accept either instance_guid or component_guid (for backward compatibility)
        instance_guid = command_data.get("instance_guid")
        if not instance_guid:
            # Fall back to component_guid if instance_guid is not provided
            instance_guid = command_data.get("component_guid")
            if not instance_guid:
                return {"status": "error", "result": "No instance_guid provided"}
        
        # Get parameters for the update operation
        file_path = command_data.get("file_path")
        param_definitions = command_data.get("param_definitions")
        description = command_data.get("description")
        name = command_data.get("name")
        force_code_reference = command_data.get("force_code_reference", False)
        
        result = update_script_with_code_reference(
            instance_guid, 
            file_path=file_path,
            param_definitions=param_definitions,
            description=description,
            name=name,
            force_code_reference=force_code_reference
        )
        
        return result
        
    elif command_type == "execute_code":
        # Execute Python code
        code = command_data.get("code", "")
        if not code:
            return {"status": "error", "result": "No code provided"}
        return execute_code(code)
        
    else:
        return {"result": "Unknown command type: " + command_type, "status": "error"}

def socket_server():
    s = socket.socket(socket.AF_INET, socket.SOCK_STREAM)
    s.setsockopt(socket.SOL_SOCKET, socket.SO_REUSEADDR, 1)
    host = "127.0.0.1"  # Bind to localhost
    port = 9999         # Use port 9999
    s.bind((host, port))
    s.listen(5)         # Allow up to 5 pending connections
    print("Socket server listening on {}:{}".format(host, port))
    A = "Socket server listening on 127.0.0.1:9999"
    
    while True:
        try:
            s.settimeout(1.0)  # Check for new connections every second.
            try:
                conn, addr = s.accept()
                conn.settimeout(5.0)  # Set timeout for receiving data
            except socket.timeout:
                continue
            
            try:
                full_data = receive_full_request(conn)
                if full_data:
                    sc.sticky["fullData"] = full_data
                if not full_data:
                    continue
                
                # Extract the payload from the HTTP request (ignoring headers)
                parts = full_data.split("\r\n\r\n")
                if len(parts) > 1:
                    command = parts[1].strip()
                else:
                    command = full_data.strip()
                
                # Parse the command into a structured format
                command_data = parse_command(command)
                sc.sticky["commandData"] = command_data
                print("Received command: " + str(command_data))

                # Handle stop command
                if command_data.get("type") == "stop":
                    print("Received stop command. Closing server.")
                    respond(conn, {"status": "stopping", "message": "Server is shutting down."})
                    conn.close()
                    break

                # Process command immediately and store result
                result = process_command(command_data)
                sc.sticky["last_result"] = result
                
                # Send response with result
                response = {
                    "status": result["status"],
                    "result": result["result"],
                    "command_type": command_data.get("type", "raw")
                }
                respond(conn, response)
            except Exception as e:
                print("Error handling request: " + str(e))
                error_response = {
                    "status": "error",
                    "result": str(e)+ str(sc.sticky["last_result"]),
                    "command_type": "error"
                }
                respond(conn, error_response)
            finally:
                try:
                    conn.close()
                except:
                    pass
        except Exception as e:
            print("Socket server error: " + str(e)+ str(sc.sticky["last_result"]))
            break
    s.close()
    sc.sticky["server_running"] = False
    print("Socket server closed.")

# Start the socket server if it isn't already running.
if not sc.sticky["server_running"]:
    sc.sticky["server_running"] = True
    thread = threading.Thread(target=socket_server)
    thread.daemon = True
    thread.start()

# Main SolveInstance processing:
if sc.sticky["last_result"]:
    result = sc.sticky["last_result"]
    sc.sticky["last_result"] = None  # Clear the result after processing
    A = "Last command result: " + json.dumps(result, cls=GHEncoder)  # Use custom encoder here too
   
else:
    A = "Waiting for command..."
# ---------- end mcp_socket_2 ----------
stopsever = GhPythonScript(trigger=Button())  # -> A
# ---------- stopsever: Python ----------
import socket
import json
import scriptcontext as sc

def stop_server():
    """Attempt to connect to the server and send a stop command.
    If the server is not running or unreachable, this times out gracefully."""
    s = socket.socket(socket.AF_INET, socket.SOCK_STREAM)
    s.settimeout(0.5)  # 2-second timeout to avoid freezing if the server isn't listening.
    
    try:
        s.connect(("127.0.0.1", 9999))
        
        # Create the JSON payload for the stop command
        payload = json.dumps({"type": "stop"})
        
        # Build a minimal HTTP request with the JSON payload
        request = (
            "POST / HTTP/1.1\r\n"
            "Host: 127.0.0.1\r\n"
            "Content-Type: application/json\r\n"
            "Content-Length: {}\r\n"
            "\r\n"
            "{}"
        ).format(len(payload), payload)
        
        # Send the request
        s.sendall(request.encode('utf-8'))
        
        # Read server response
        response = s.recv(4096)
        return response.decode('utf-8')
    except Exception as e:
        return "Server stop request failed or timed out: " + str(e)
    finally:
        try:
            s.close()
        except:
            pass

if trigger == False:
    # 1) Stop the server (if it’s running).
    server_response = stop_server()
    print("Server stop response:", server_response)

    # 2) Reset sticky variables to clear state so you can restart the server fresh.
    sc.sticky["server_running"] = False
    sc.sticky["server_thread"] = None
    sc.sticky["last_result"] = None
    sc.sticky["command"] = None
    
    sc.sticky["stopStatus"] = "Stop command sent. Sticky variables reset.\n\nServer response:\n" + server_response

try:
    A = sc.sticky["stopStatus"]
except:
    A =""
# ---------- end stopsever ----------
ghpython_script_2 = GhPythonScript()  # -> out, a
# ---------- ghpython_script_2: Python ----------
import System
import Grasshopper as gh
import Grasshopper

import System
import Grasshopper as gh
import Grasshopper

import System
import Grasshopper as gh
import Grasshopper
import System
import Grasshopper as gh
import System
import Grasshopper as gh
import Grasshopper
import System
import Grasshopper as gh
import Grasshopper

def update_script_with_code_reference(instance_guid, file_path=None, param_definitions=None, description=None, name=None, force_code_reference=False):
    """
    Updates a script component to use code from an external file.
    """
    doc = ghenv.Component.OnPingDocument()
    target_guid = System.Guid.Parse(instance_guid)
    comp = doc.FindObject(target_guid, False)
    
    if comp is None:
        return {"status": "error", "result": "Component not found"}
    
    result = {"status": "error", "result": "Unknown error"}
    
    # Freeze the canvas
    gh.Instances.ActiveCanvas.Enabled = False
    
    try:
        if force_code_reference:
            # APPROACH 1: Try to completely reset the component's internal state
            
            # First, clear any existing code
            if hasattr(comp, "Code"):
                # Set component's code to a minimal script that forces external code usage
                comp.Code = "# This component is set to use external code"
            
            # Toggle InputIsPath off and on
            comp.InputIsPath = False
            comp.InputIsPath = True
            
            # Remove any existing code parameter
            for p in list(comp.Params.Input):
                if p.Name == "code":
                    comp.Params.UnregisterInputParameter(p)
            
            # Create fresh code parameter
            code_param = comp.ConstructCodeInputParameter()
            code_param.NickName = "code"
            code_param.Name = "code"
            code_param.Description = "Path to Python code file"
            
            # Force a rebuild of the component
            comp.ClearData()
            comp.Attributes.ExpireLayout()
            comp.ExpireSolution(True)
            doc.DestroyAttributeCache()
            
            # Register the parameter
            comp.Params.RegisterInputParam(code_param)
            
            # Set InputIsPath again
            comp.InputIsPath = True
            
            # Set file path if provided
            if file_path is not None:
                code_param.AddVolatileData(Grasshopper.Kernel.Data.GH_Path(0), 0, file_path)
            
            # APPROACH 2: Try manipulating document-level features to force update
            comp.Phase = Grasshopper.Kernel.GH_SolutionPhase.Blank  # Reset solution phase
            
            # Force the component to be "dirty" to ensure recomputation
            if hasattr(comp, "OnPingDocument"):
                comp_doc = comp.OnPingDocument()
                if comp_doc:
                    comp_doc.ScheduleSolution(5)  # Schedule a solution update
        
        # Handle param definitions but preserve code input
        if param_definitions is not None:
            default_description = "Dynamically added parameter"
            
            # Add temporary dummy parameters
            dummy_input = create_input_param({"description": "Temporary parameter"}, "__dummy_input__", default_description)
            dummy_output = create_output_param({"description": "Temporary parameter"}, "__dummy_output__")
            
            comp.Params.RegisterInputParam(dummy_input)
            comp.Params.RegisterOutputParam(dummy_output)
            
            # Clear existing inputs/outputs except code input and dummies
            for p in list(comp.Params.Input):
                if p.Name != "__dummy_input__" and p.Name != "code":
                    comp.Params.UnregisterInputParameter(p)
                    
            for p in list(comp.Params.Output):
                if p.Name != "__dummy_output__":
                    comp.Params.UnregisterOutputParameter(p)
            
            # Add new inputs (skip code parameter)
            inputs = [d for d in param_definitions if d.get("type", "").lower() == "input" 
                      and d.get("name", "").lower() != "code"]
            
            for d in inputs:
                if "name" not in d:
                    continue
                name_val = d["name"]
                new_param = create_input_param(d, name_val, default_description)
                comp.Params.RegisterInputParam(new_param)
            
            # Add new outputs
            outputs = [d for d in param_definitions if d.get("type", "").lower() == "output"]
            for d in outputs:
                if "name" not in d:
                    continue
                name_val = d["name"]
                new_param = create_output_param(d, name_val)
                comp.Params.RegisterOutputParam(new_param)
            
            # Ensure there's always an output parameter
            out_names = [d.get("name", "").lower() for d in outputs]
            if "output" not in out_names:
                default_out = create_output_param({"description": "Default output"}, "output")
                comp.Params.RegisterOutputParam(default_out)
            
            # Remove dummy parameters
            comp.Params.UnregisterInputParameter(dummy_input)
            comp.Params.UnregisterOutputParameter(dummy_output)
        
        # Update description and name if provided
        if description is not None:
            comp.Description = description
        
        if name is not None:
            comp.NickName = name
        
        # Final force update
        comp.ClearData()
        comp.Attributes.ExpireLayout()
        comp.ExpireSolution(True)
        
        result = {
            "status": "success",
            "result": {
                "code_reference_enforced": force_code_reference,
                "file_path_set": file_path is not None,
                "description_updated": description is not None,
                "name_updated": name is not None
            }
        }
    except Exception as e:
        result = {"status": "error", "result": str(e) }
    finally:
        # Always unfreeze the UI
        doc.DestroyAttributeCache()
        gh.Instances.ActiveCanvas.Enabled = True
    
    return result
    
a = update_script_with_code_reference("5726fee3-6985-4929-9088-4dea9345629e", file_path="rhino_mcp/hellow_world.py", param_definitions=None, description="some", name="myName", force_code_reference=True)
a = str(a)
# ---------- end ghpython_script_2 ----------
ghpython_script_3 = GhPythonScript()  # -> out, a, b
# ---------- ghpython_script_3: Python ----------
import rhinoscriptsyntax as rs
import System
import Grasshopper as gh
#from Grasshopper.Kernel.Special.GhPython import GhPythonComponent

def add_code_input(instance_guid):
    """Adds a code input parameter to a GHPython component."""
    doc = ghenv.Component.OnPingDocument()
    target_guid = System.Guid.Parse(instance_guid)
    component = doc.FindObject(target_guid, False)
    

    
    # Disable UI updates
    gh.Instances.ActiveCanvas.Enabled = False
    
    # Set this to true to indicate this is a file path
    print(component.InputIsPath)
    component.InputIsPath = True
    
    # Clear existing connections to code input if it exists
    if component.IsCodeInputLinked():
        for p in list(component.Params.Input):
            if p.Name == "code":
                component.Params.UnregisterInputParameter(p)
    
    # Create code parameter
    code_param = component.ConstructCodeInputParameter()
    code_param.NickName = "Code"
    code_param.Name = "code"
    code_param.Description = "Path to Python code file"
    
    # Register the parameter
    component.Params.RegisterInputParam(code_param)
    
    # Clear data to ensure fresh connections
    component.ClearData()
    
    # Re-enable canvas and update
    gh.Instances.ActiveCanvas.Enabled = True
    
    # Expire component to update UI
    component.Attributes.ExpireLayout()
    component.ExpireSolution(True)
    doc.DestroyAttributeCache()
    
    print("Code input parameter added successfully")

# Example usage:
add_code_input("5726fee3-6985-4929-9088-4dea9345629e")
# ---------- end ghpython_script_3 ----------
panel = Panel(stopsever)
panel_2 = Panel(test_message)
panel_3 = Panel(ghpython_script.A)
ghpython_script_4 = GhPythonScript()  # -> out, a
# ---------- ghpython_script_4: Python ----------
import rhinoscriptsyntax as rs
import System
import Grasshopper as gh
#from Grasshopper.Kernel.Special.GhPython import GhPythonComponent

def add_code_input(instance_guid):
    """Adds a code input parameter to a GHPython component."""
    doc = ghenv.Component.OnPingDocument()
    target_guid = System.Guid.Parse(instance_guid)
    component = doc.FindObject(target_guid, False)
    

    
    # Disable UI updates
    gh.Instances.ActiveCanvas.Enabled = False
    
    # Set this to true to indicate this is a file path
    print(component.InputIsPath)
    component.InputIsPath = True
    
    # Clear existing connections to code input if it exists
    if component.IsCodeInputLinked():
        for p in list(component.Params.Input):
            if p.Name == "code":
                component.Params.UnregisterInputParameter(p)
    
    # Create code parameter
    code_param = component.ConstructCodeInputParameter()
    code_param.NickName = "Code"
    code_param.Name = "code"
    code_param.Description = "Path to Python code file"
    
    # Register the parameter
    component.Params.RegisterInputParam(code_param)
    
    # Clear data to ensure fresh connections
    component.ClearData()
    
    # Re-enable canvas and update
    gh.Instances.ActiveCanvas.Enabled = True
    
    # Expire component to update UI
    component.Attributes.ExpireLayout()
    component.ExpireSolution(True)
    doc.DestroyAttributeCache()
    
    print("Code input parameter added successfully")

# Example usage:

doc = ghenv.Component.OnPingDocument()
target_guid = System.Guid.Parse("5726fee3-6985-4929-9088-4dea9345629e")
component = doc.FindObject(target_guid, False)


a = dir(component)
l = component.RuntimeMessageLevel
rm = str(component.RuntimeMessages(component.RuntimeMessageLevel)).replace("List[str]","")
print rm
# ---------- end ghpython_script_4 ----------
ghpython_script_5 = GhPythonScript()  # -> output, layers, core, all_geometry, metadata
#   port layer_count: Number of metal sheet layers
# ---------- ghpython_script_5: Python ----------
import Rhino.Geometry as rg
import math

# Get input parameters
layer_count = int(layer_count)
base_radius = float(base_radius)
top_radius = float(top_radius)
layer_thickness = float(layer_thickness) 
layer_gap = float(layer_gap)
twist_angle = float(twist_angle)
core_radius = float(core_radius)

# Calculate total height
total_height = layer_count * (layer_thickness + layer_gap) - layer_gap

# Initialize empty lists for outputs
sheets = []
light_core = None
frame_curves = []
all_geometry = []

# Create each layer
for i in range(layer_count):
    # Calculate z position for current layer
    z_pos = i * (layer_thickness + layer_gap)
    
    # Calculate interpolated radius for current layer (linear interpolation)
    t = float(i) / max(1, layer_count - 1)  # Normalized height (0 to 1)
    current_radius = base_radius * (1 - t) + top_radius * t
    
    # Calculate rotation for this layer
    rotation_angle = math.radians(i * twist_angle)
    
    # Create the sheet as a cylinder with small height
    circle = rg.Circle(rg.Point3d(0, 0, z_pos), current_radius)
    layer = rg.Cylinder(circle, layer_thickness)
    layer_brep = layer.ToBrep(True, True)
    
    # Rotate the layer if needed
    if rotation_angle != 0:
        transform = rg.Transform.Rotation(rotation_angle, rg.Vector3d.ZAxis, rg.Point3d.Origin)
        layer_brep.Transform(transform)
    
    # Create cutout for the light core
    if core_radius > 0:
        core_circle = rg.Circle(rg.Point3d(0, 0, z_pos), core_radius)
        core_cylinder = rg.Cylinder(core_circle, layer_thickness)
        core_brep = core_cylinder.ToBrep(True, True)
        
        # Subtract core from layer
        diff = rg.Brep.CreateBooleanDifference(layer_brep, core_brep, 0.01)
        if diff and len(diff) > 0:
            layer_brep = diff[0]
    
    # Add to list
    sheets.append(layer_brep)
    
    # Create frame curves for the layer edges
    top_circle = rg.Circle(rg.Point3d(0, 0, z_pos + layer_thickness), current_radius)
    top_curve = top_circle.ToNurbsCurve()
    if rotation_angle != 0:
        top_curve.Transform(transform)
    frame_curves.append(top_curve)

# Create light core
if core_radius > 0:
    core_circle = rg.Circle(rg.Point3d(0, 0, 0), core_radius)
    light_core = rg.Cylinder(core_circle, total_height)
    light_core = light_core.ToBrep(True, True)

# Combine all geometry - fixed to use list slicing instead of .copy()
all_geometry = sheets[:]  # This creates a copy of the sheets list
if light_core:
    all_geometry.append(light_core)

# Output the results
layers = sheets
core = light_core
metadata = {
    "total_height": total_height,
    "layer_count": layer_count,
    "core_radius": core_radius
}
output = "Chandelier created with " + str(layer_count) + " layers"
# ---------- end ghpython_script_5 ----------
panel_4 = Panel(last_command.d)
ghpython_script_6 = GhPythonScript(Code=relativepath, X=number_slider_8, Y=number_slider_8)  # -> Out, A
panel_5 = Panel(ghpython_script_4.a)
ghpython_script_7 = GhPythonScript()  # -> out, A; inputs x: tree of Point3d, y: list
# ---------- ghpython_script_7: Python ----------
import scriptcontext as sc
import json
import Grasshopper
import Rhino.Geometry as rg

def get_param_info(param, is_input=True):
    """Collect basic information from a Grasshopper parameter.
    
    For input parameters (is_input=True), include 'InputAccess' and 'dataTypeHint'.
    For output parameters, those are omitted.
    """
    info = {}
    try:
        info["Name"] = param.Name
        info["NickName"] = param.NickName
        info["InstanceGuid"] = str(param.InstanceGuid)
        info["hasData"] = str(param.DataType)
        info["DataMapping"] = str(param.DataMapping)
        if is_input:
            try:
                info["InputAccess"] = str(param.Access)
            except Exception as e:
                info["InputAccess"] = "N/A"
            try:
                info["dataTypeHint"] = str(param.TypeHint)
            except Exception as e:
                info["dataTypeHint"] = "N/A"
    except Exception as e:
        info["Error"] = str(e)
    return info

def get_component_info(comp):
    """Collect basic information from a Grasshopper component including its input/output parameters."""
    info = {}
    try:
        info["Name"] = comp.Name
        info["NickName"] = comp.NickName
        info["Description"] = comp.Description
        info["Category"] = comp.Category
        info["SubCategory"] = comp.SubCategory
        info["InstanceGuid"] = str(comp.InstanceGuid)
        info["RunTimeMessages"] = str(comp.RuntimeMessages(comp.RuntimeMessageLevel)).replace("List[str]()","")
        
        # Get visual attributes if available.
        if hasattr(comp, "Attributes") and comp.Attributes:
            pivot = comp.Attributes.Pivot
            bounds = comp.Attributes.Bounds
            info["Pivot"] = {"X": float(pivot.X), "Y": float(pivot.Y)}
            # Optionally include bounds details:
            # info["Bounds"] = {
            #     "X": float(bounds.X),
            #     "Y": float(bounds.Y),
            #     "Width": float(bounds.Width),
            #     "Height": float(bounds.Height)
            # }
        
        # If the component is a script component, add its code.
        if comp.SubCategory == "Script":
            if hasattr(comp, "Code"):
                info["Code"] = comp.Code
            else:
                info["Code"] = "No code attribute found"
        
        # Get input and output parameter info if available.
        if hasattr(comp, "Params"):
            if hasattr(comp.Params, "Input"):
                info["Inputs"] = [get_param_info(p, is_input=True) for p in comp.Params.Input]
            if hasattr(comp.Params, "Output"):
                info["Outputs"] = [get_param_info(p, is_input=False) for p in comp.Params.Output]
    except Exception as e:
        info["Error"] = str(e)
    return info

# Get the active Grasshopper document.
ghdoc = ghenv.Component.OnPingDocument()

# Find selected components using the Attributes.Selected property.
selected_components = []
for obj in ghdoc.Objects:
    if hasattr(obj, "Attributes") and hasattr(obj.Attributes, "Selected"):
        if obj.Attributes.Selected:
            selected_components.append(obj)

if selected_components:
    results = [get_component_info(comp) for comp in selected_components]
    result_str = json.dumps(results, indent=4)
    print(result_str)
    A = result_str  # Output for the GH Python component.
else:
    print("No components selected.")
    A = "No components selected."
# ---------- end ghpython_script_7 ----------
myname = GhPythonScript(X=number_slider_8, Y=number_slider_8)  # -> Out, A
ghpython_script_8 = GhPythonScript()  # -> out, a
# ---------- ghpython_script_8: Python ----------
__author__ = "Joo"

import rhinoscriptsyntax as rs
import Grasshopper
#print dir(Grasshopper.Instances.ActiveCanvas.Document)



a = dir(Grasshopper.Instances.ActiveCanvas.Document)

print Grasshopper.Instances.ActiveCanvas.Document

Grasshopper.Instances.ActiveCanvas.Document
# ---------- end ghpython_script_8 ----------
panel_6 = Panel(ghpython_script_8.a)
panel_7 = Panel(ghpython_script_3.b)
# codeContext -> code nodes with referenced code-> check for volatile data to see file path!
python = GhPythonScript(GhMemory=0)  # -> out, a
# ---------- python: Python ----------
import Rhino.Geometry as rg
import math
import random

# Process the core geometry
if core:
    # Get the core's bounding box
    bbox = core.GetBoundingBox(True)
    height = bbox.Max.Z - bbox.Min.Z
    radius = bbox.Max.X  # Assuming cylinder is centered at origin
    
    # Create a DNA helix light structure inside the core
    points = []
    spheres = []
    helix_radius = radius * 0.6
    turns = 3.0
    light_count = 20
    
    # Create the main DNA double-helix pattern
    for i in range(light_count):
        t = float(i) / (light_count - 1)  # 0 to 1
        z = t * height
        
        # First helix strand
        angle1 = t * turns * 2 * math.pi
        x1 = helix_radius * math.cos(angle1)
        y1 = helix_radius * math.sin(angle1)
        pt1 = rg.Point3d(x1, y1, z)
        points.append(pt1)
        
        # Create a glowing sphere at this point
        sphere1 = rg.Sphere(pt1, radius * 0.15)
        spheres.append(sphere1.ToBrep())
        
        # Second helix strand (offset by 180 degrees)
        angle2 = angle1 + math.pi
        x2 = helix_radius * math.cos(angle2)
        y2 = helix_radius * math.sin(angle2)
        pt2 = rg.Point3d(x2, y2, z)
        points.append(pt2)
        
        # Create a glowing sphere at this point
        sphere2 = rg.Sphere(pt2, radius * 0.15)
        spheres.append(sphere2.ToBrep())
        
        # Create connecting bridges every few steps (like DNA base pairs)
        if i % 3 == 0 and i > 0 and i < light_count - 1:
            # Create a thin cylinder connecting the points
            line = rg.Line(pt1, pt2)
            connector = rg.Cylinder(
                rg.Circle(
                    rg.Plane(pt1, rg.Vector3d(pt2 - pt1)), 
                    radius * 0.05
                ), 
                line.Length
            )
            spheres.append(connector.ToBrep(True, True))
    
    # Create curves through the helix points
    helix_curves = []
    
    # Split points into the two strands
    strand1 = [points[i] for i in range(0, len(points), 2)]
    strand2 = [points[i] for i in range(1, len(points), 2)]
    
    # Create interpolated curves through each strand
    if len(strand1) >= 3:
        curve1 = rg.Curve.CreateInterpolatedCurve(strand1, 3)
        if curve1:
            helix_curves.append(curve1)
    
    if len(strand2) >= 3:
        curve2 = rg.Curve.CreateInterpolatedCurve(strand2, 3)
        if curve2:
            helix_curves.append(curve2)
    
    # Create some small floating accent lights
    accent_lights = []
    for i in range(30):
        # Random position within the core
        angle = random.random() * 2 * math.pi
        r = random.random() * radius * 0.5
        z = random.random() * height
        pt = rg.Point3d(r * math.cos(angle), r * math.sin(angle), z)
        
        # Small glowing sphere
        small_sphere = rg.Sphere(pt, radius * 0.05)
        accent_lights.append(small_sphere.ToBrep())
    
    # Enhance the core with some glowing effect
    enhanced_core = core
    
    # Create a slightly larger transparent cylinder for glow effect
    glow_circle = rg.Circle(rg.Point3d(0, 0, 0), radius * 1.1)
    glow_cylinder = rg.Cylinder(glow_circle, height)
    glow_effect = glow_cylinder.ToBrep(True, True)
    
    # Output results
    light_structures = spheres + accent_lights
    light_positions = points
    curves = helix_curves
    glow = glow_effect
    
    stats = {
        "height": height,
        "radius": radius,
        "light_count": light_count * 2,
        "accent_count": len(accent_lights)
    }
    
    a = light_structures
else:
    enhanced_core = None
    light_positions = []
    light_structures = []
    curves = []
    glow = None
    stats = {"status": "No core geometry received"}
    a = None
# ---------- end python ----------
ghpython_script_9 = GhPythonScript()  # -> output, cubes, debug
#   port cube_size: The size of each cube.
#   port num_cubes: The number of cubes to create.
#   port bounds: The 3D bounding box to confine the cubes.
#   port twist_angle: The angle by which to twist each cube (in radians).
#   port cubes: List of twisted cubes as Breps.
# ---------- ghpython_script_9: Python ----------
import Rhino.Geometry as rg
import random

# Function to create a random distribution of twisted cubes
# cube_size: the size of each cube
# num_cubes: the number of cubes to create
# bounds: the 3D bounding box to confine the cubes
# twist_angle: the angle by which to twist each cube
def create_twisted_random_cubes(cube_size, num_cubes, bounds, twist_angle):
    cubes = []  # List to store generated cubes
    for _ in range(num_cubes):
        # Generate a random point within the bounding box
        x = random.uniform(bounds.Min.X, bounds.Max.X)  # Random x-coordinate
        y = random.uniform(bounds.Min.Y, bounds.Max.Y)  # Random y-coordinate
        z = random.uniform(bounds.Min.Z, bounds.Max.Z)  # Random z-coordinate
        center = rg.Point3d(x, y, z)  # Create a point from random coordinates

        # Create a cube centered at the random point
        # Define a plane at the center point with Z axis as normal
        plane = rg.Plane(center, rg.Vector3d.ZAxis)
        # Define the cube using intervals from the center point
        cube = rg.Box(plane, 
                      rg.Interval(-cube_size/2, cube_size/2),  # X interval
                      rg.Interval(-cube_size/2, cube_size/2),  # Y interval
                      rg.Interval(-cube_size/2, cube_size/2))  # Z interval
        
        # Create a transformation to twist the cube
        twist_transform = rg.Transform.Rotation(twist_angle, rg.Vector3d.ZAxis, center)
        
        # Apply the twist transformation to the cube
        twisted_cube = cube.ToBrep()
        twisted_cube.Transform(twist_transform)
        cubes.append(twisted_cube)  # Add the twisted cube to the list
    return cubes  # Return the list of twisted cubes

# Create twisted random cubes
cubes = create_twisted_random_cubes(cube_size, num_cubes, bounds, twist_angle)

# Set the output
output = cubes
# ---------- end ghpython_script_9 ----------
trigger_2 = BooleanToggle(True)
vibecode_gh_server_running = GhPythonScript(RunServer=trigger_2)  # -> A
# ---------- vibecode_gh_server_running: Python ----------
# IronPython 2.7
import scriptcontext as sc
import clr
import socket
import threading
import json
import System
from System import Guid
from System.Drawing import RectangleF
import traceback # To log detailed errors
import time # Ensure time is imported
import re # Add import for regular expressions
import Rhino # 
# Add References
clr.AddReference("System")
clr.AddReference("System.Drawing")
clr.AddReference("Grasshopper")

# Imports for Grasshopper types
import Grasshopper
import Grasshopper as gh
from Grasshopper.Kernel import GH_ParamAccess
from Grasshopper.Kernel.Parameters import (
    Param_GenericObject, Param_String, Param_Number,
    Param_Integer, Param_Boolean, Param_Guid, Param_Point,
    Param_Vector, Param_Curve, Param_Surface, Param_Brep, Param_Mesh
)
# Import Action for Rhino.RhinoApp.InvokeOnUiThread
from System import Action

# --- Constants ---
HOST = "127.0.0.1"
PORT = 9998 # Use port 9998
COMPONENT_NICKNAME = "VibeCode GH Server" # Set a nickname for the component running this script

# --- Script Context Sticky Management ---
# Use scriptcontext.sticky as a persistent dictionary.
if "server_running" not in sc.sticky:
    sc.sticky["server_running"] = False
if "server_thread" not in sc.sticky:
    sc.sticky["server_thread"] = None
if "last_error" not in sc.sticky:
    sc.sticky["last_error"] = None

# --- JSON Encoding ---
class GHEncoder(json.JSONEncoder):
    """Custom JSON encoder for basic types, prevents errors with complex GH types."""
    def default(self, obj):
        if isinstance(obj, System.Guid):
            return str(obj)
        # Add other simple type conversions if needed, but avoid complex geometry
        # For most communication, we'll stick to strings, numbers, bools, lists, dicts
        try:
            return json.JSONEncoder.default(self, obj)
        except TypeError:
            return repr(obj) # Fallback to representation string

# --- Grasshopper Interaction Functions ---

def find_script_components(doc):
    """Finds all script components in the document."""
    script_components = []
    if not doc:
        return script_components
    for obj in doc.Objects:
        # Check if it's a component and likely a script component
        # (Checking for 'Code' attribute is a good indicator for GHPython)
        if isinstance(obj, Grasshopper.Kernel.IGH_Component) and hasattr(obj, "Code"):
             script_components.append(obj)
    return script_components

def get_selected_script_component_details():
    """
    Checks the current selection in Grasshopper.
    If exactly one script component is selected, returns its details.
    Otherwise, returns None or an indicator status.
    """
    doc = ghenv.Component.OnPingDocument()
    if not doc:
        return {"status": "error", "result": "No active Grasshopper document"}

    selected_script_components = []
    for obj in doc.Objects:
        if hasattr(obj, "Attributes") and obj.Attributes.Selected:
            # Check if it's a script component (e.g., GHPython)
            if isinstance(obj, Grasshopper.Kernel.IGH_Component) and hasattr(obj, "Code"):
                selected_script_components.append(obj)

    if len(selected_script_components) == 1:
        comp = selected_script_components[0]
        details = {
            "instance_guid": str(comp.InstanceGuid),
            "code": comp.Code if hasattr(comp, "Code") else "# Code attribute not found",
            "description": comp.Description,
            "param_definitions": format_params_for_webapp(comp)
        }
        return {"status": "success", "result": details}
    elif len(selected_script_components) == 0:
        return {"status": "none_selected", "result": "No script component selected"}
    else:
        return {"status": "multiple_selected", "result": "Multiple script components selected"}

def format_params_for_webapp(component):
    """Formats component parameters into the structure expected by the web app."""
    param_definitions = []
    if not hasattr(component, "Params"):
        return param_definitions

    # Process Inputs
    if hasattr(component.Params, "Input"):
        for p in component.Params.Input:
            param_info = {
                "type": "input",
                "name": p.NickName or p.Name, # Prefer NickName if available
                "description": p.Description,
                "access": get_access_string(p.Access),
                "typehint": get_typehint_string(p),
                "optional": p.Optional
            }
            param_definitions.append(param_info)

    # Process Outputs
    if hasattr(component.Params, "Output"):
        for p in component.Params.Output:
             # Outputs are simpler in the webapp's view
            param_info = {
                "type": "output",
                "name": p.NickName or p.Name,
                "description": p.Description
            }
            param_definitions.append(param_info)

    return param_definitions

def get_access_string(gh_param_access):
    """Converts GH_ParamAccess enum to string."""
    if gh_param_access == GH_ParamAccess.item:
        return "item"
    elif gh_param_access == GH_ParamAccess.tree:
        return "tree"
    else: # Default to list
        return "list"

def get_typehint_string(param):
    """Attempts to guess a simple typehint string from the parameter type."""
    # This provides a basic mapping. More specific hints might require checking param.TypeHint if available and reliable.
    if isinstance(param, Param_String): return "str"
    if isinstance(param, Param_Integer): return "int"
    if isinstance(param, Param_Number): return "float"
    if isinstance(param, Param_Boolean): return "bool"
    if isinstance(param, Param_Guid): return "guid"
    if isinstance(param, Param_Point): return "point"
    if isinstance(param, Param_Vector): return "vector"
    if isinstance(param, Param_Curve): return "curve"
    if isinstance(param, Param_Surface): return "surface"
    if isinstance(param, Param_Brep): return "brep"
    if isinstance(param, Param_Mesh): return "mesh"
    # Default for Param_GenericObject or others
    return "generic"

def get_access_enum(access_str):
    """Converts string ('item', 'list', 'tree') to GH_ParamAccess enum."""
    s = str(access_str).lower()
    if s == "item":
        return GH_ParamAccess.item
    elif s == "tree":
        return GH_ParamAccess.tree
    # Default to list for unknown or missing values
    return GH_ParamAccess.list

def create_gh_input_param(param_def):
    """Creates a Grasshopper input parameter from a definition dictionary."""
    name = param_def.get("name", "input")
    hint = param_def.get("typehint", "generic").lower()
    description = param_def.get("description", "Input parameter")
    access = get_access_enum(param_def.get("access", "list"))
    optional = param_def.get("optional", True)

    # Choose parameter type based on hint
    if hint == "str": param = Param_String()
    elif hint == "int": param = Param_Integer()
    elif hint == "float": param = Param_Number()
    elif hint == "bool": param = Param_Boolean()
    elif hint == "guid": param = Param_Guid()
    elif hint == "point": param = Param_Point()
    elif hint == "vector": param = Param_Vector()
    elif hint == "curve": param = Param_Curve()
    elif hint == "surface": param = Param_Surface()
    elif hint == "brep": param = Param_Brep()
    elif hint == "mesh": param = Param_Mesh()
    else: param = Param_GenericObject() # Default

    param.Name = name
    param.NickName = name
    param.Description = description
    param.Access = access
    param.Optional = optional
    # We don't set param.TypeHint explicitly here to allow users
    # to still change the type via the context menu if needed.
    # The component's behavior relies on the actual parameter *type*.

    return param

def create_gh_output_param(param_def):
    """Creates a Grasshopper output parameter from a definition dictionary."""
    name = param_def.get("name", "output")
    description = param_def.get("description", "Output parameter")

    # Outputs are typically generic unless specific typing is strictly needed
    param = Param_GenericObject()
    param.Name = name
    param.NickName = name
    param.Description = description

    return param

def update_script_component_on_ui_thread(instance_guid_str, code, description, param_definitions):
    """
    Wrapper function to perform the component update on the UI thread.
    Handles finding the component, updating code, description, and parameters.
    Uses a dummy parameter strategy for robust parameter updates.
    Returns a dictionary indicating success or failure.
    """
    result = {"status": "error", "result": "Update failed"} # Default result
    comp = None # Define comp outside try block for finally clause
    canvas = None # Define canvas outside try block for finally clause

    try:
        doc = ghenv.Component.OnPingDocument()
        if not doc:
            return {"status": "error", "result": "No active Grasshopper document"}

        try:
            target_instance_guid = Guid.Parse(instance_guid_str)
        except Exception as e:
             return {"status": "error", "result": "Invalid instance GUID format: {}".format(e)}

        comp = doc.FindObject(target_instance_guid, False)
        if comp is None:
            return {"status": "error", "result": "Component with GUID {} not found.".format(instance_guid_str)}

        # Check if it's actually a script component we can modify
        if not (isinstance(comp, Grasshopper.Kernel.IGH_Component) and hasattr(comp, "Code")):
             return {"status": "error", "result": "Target component (GUID: {}) is not a recognized script component.".format(instance_guid_str)}

        # --- Perform Updates ---
        code_updated = False
        params_updated = False
        description_updated = False

        # Freeze canvas/document during modification
        canvas = gh.Instances.ActiveCanvas # Use gh alias
        if canvas: canvas.Document.Enabled = False # Use Document.Enabled for safety

        try:
            # 1. Update Parameters if definitions are provided
            if param_definitions is not None:
                dummy_input = None
                dummy_output = None
                try:
                    # --- Start Dummy Parameter Strategy ---
                    # Step 1: Add temporary dummy parameters
                    dummy_input_def = {"name": "__dummy_in__", "description": "Temp"}
                    dummy_output_def = {"name": "__dummy_out__", "description": "Temp"}
                    dummy_input = create_gh_input_param(dummy_input_def)
                    dummy_output = create_gh_output_param(dummy_output_def)

                    comp.Params.RegisterInputParam(dummy_input)
                    comp.Params.RegisterOutputParam(dummy_output)

                    # Step 2: Clear existing inputs and outputs (except dummies)
                    # Create lists to avoid modifying the collection while iterating
                    inputs_to_remove = [p for p in comp.Params.Input if p.InstanceGuid != dummy_input.InstanceGuid]
                    outputs_to_remove = [p for p in comp.Params.Output if p.InstanceGuid != dummy_output.InstanceGuid]

                    for p in inputs_to_remove:
                        comp.Params.UnregisterInputParameter(p)
                    for p in outputs_to_remove:
                        comp.Params.UnregisterOutputParameter(p)

                    # Step 3: Process and add the new parameters
                    input_params = []
                    output_params = []

                    for p_def in param_definitions:
                        param_type = p_def.get("type", "").lower()
                        if param_type == "input":
                            new_param = create_gh_input_param(p_def)
                            comp.Params.RegisterInputParam(new_param)
                            input_params.append(new_param)
                        elif param_type == "output":
                            new_param = create_gh_output_param(p_def)
                            comp.Params.RegisterOutputParam(new_param)
                            output_params.append(new_param)

                    # Ensure default 'output' exists if no outputs were defined
                    # Check against newly added params and the dummy
                    current_output_names = [p.Name for p in comp.Params.Output]
                    if "output" not in current_output_names and "__dummy_out__" not in current_output_names:
                         default_out = create_gh_output_param({"name": "output", "description": "Default output"})
                         comp.Params.RegisterOutputParam(default_out)
                         output_params.append(default_out) # Track it

                    # Step 4: Remove the dummy parameters
                    if dummy_input:
                        comp.Params.UnregisterInputParameter(dummy_input)
                    if dummy_output:
                        comp.Params.UnregisterOutputParameter(dummy_output)
                    # --- End Dummy Parameter Strategy ---

                    # Trigger layout update *after* all changes are done
                    comp.Params.OnParametersChanged()
                    if hasattr(comp, "Attributes"): comp.Attributes.ExpireLayout()
                    # doc.DestroyAttributeCache() # ExpireLayout should handle this

                    params_updated = True
                except Exception as e:
                    sc.sticky["last_error"] = "Parameter update failed: {}".format(e)
                    print("Error during parameter update: {}".format(e)) # Log error
                    # Attempt to remove dummies even if error occurred
                    try:
                        if dummy_input and dummy_input in comp.Params.Input: comp.Params.UnregisterInputParameter(dummy_input)
                        if dummy_output and dummy_output in comp.Params.Output: comp.Params.UnregisterOutputParameter(dummy_output)
                    except: pass # Ignore cleanup errors
                    # Continue with other updates if possible

            # 2. Update Code if provided
            if code is not None:
                try:
                    comp.Code = str(code)
                    code_updated = True
                except Exception as e:
                     sc.sticky["last_error"] = "Code update failed: {}".format(e)
                     print("Error during code update: {}".format(e)) # Log error
                     # Continue if possible

            # 3. Update Description if provided
            if description is not None:
                try:
                    comp.Description = str(description)
                    description_updated = True
                except Exception as e:
                     sc.sticky["last_error"] = "Description update failed: {}".format(e)
                     print("Error during description update: {}".format(e)) # Log error
                     # Continue if possible

            # Expire solution to reflect changes AFTER all updates
            comp.ExpireSolution(True)

            result = {
                "status": "success",
                "result": {
                    "code_updated": code_updated,
                    "params_updated": params_updated,
                    "description_updated": description_updated,
                    "component_type": type(comp).__name__
                }
            }

        except Exception as e:
            # Catch errors during the update process itself
            result = {"status": "error", "result": "Error during component update: {}".format(e)}
            sc.sticky["last_error"] = result["result"]
            print("Error during component update process: {}".format(e)) # Log error
        finally:
            # CRITICAL: Always re-enable the canvas/document
            if canvas: canvas.Document.Enabled = True
            # Maybe force a redraw one last time
            if comp and hasattr(comp, "Attributes"): comp.Attributes.ExpireLayout() # Expire layout again after enabling doc
            if canvas: canvas.Refresh() # Refresh canvas to show changes

    except Exception as e:
        # Catch errors in finding component or parsing GUID
        result = {"status": "error", "result": "Outer error updating component: {}".format(e)}
        sc.sticky["last_error"] = result["result"]
        print("Outer error during component update: {}".format(e)) # Log error

    return result


# --- HTTP Server Logic ---

def socket_server_thread():
    """Background thread function to run the HTTP server."""
    host = '127.0.0.1'
    port = 9998
    server_socket = None

    try:
        server_socket = socket.socket(socket.AF_INET, socket.SOCK_STREAM)
        server_socket.setsockopt(socket.SOL_SOCKET, socket.SO_REUSEADDR, 1)
        server_socket.bind((host, port))
        server_socket.listen(5)
        sc.sticky["server_status"] = "Server listening on port {}".format(port)
        sc.sticky.pop("server_thread_error", None)

        while sc.sticky.get("run_server", True):
            conn = None
            addr = None
            try:
                # Use blocking accept initially, but with a timeout for the loop
                server_socket.settimeout(1.0)
                conn, addr = server_socket.accept()
                conn.settimeout(10.0) # Set timeout for operations on this connection
                sc.sticky["last_connection_addr"] = str(addr)

                # --- Read Request Headers ---
                headers_raw = ""
                while True:
                    try:
                        line = conn.recv(1024) # Read line by line (approx)
                        if not line: # Connection closed
                            headers_raw = "" # Reset if closed before headers end
                            break
                        headers_raw += line
                        if "\r\n\r\n" in headers_raw:
                            break
                        # Safety break for excessively long headers
                        if len(headers_raw) > 8192:
                             raise ValueError("Headers too large")
                    except socket.timeout:
                        raise socket.timeout("Timeout reading request headers")
                    except Exception as header_err:
                         raise ValueError("Error reading headers: {}".format(header_err))

                if not headers_raw or "\r\n\r\n" not in headers_raw:
                     # Connection closed or malformed before headers complete
                     if conn: conn.close()
                     continue # Go back to accept

                header_part, body_start = headers_raw.split("\r\n\r\n", 1)
                header_lines = header_part.split("\r\n")
                if not header_lines:
                    raise ValueError("Malformed headers received")

                # --- Parse Request Line and Headers ---
                request_line = header_lines[0]
                request_line_parts = request_line.split(' ')
                if len(request_line_parts) < 2:
                     raise ValueError("Malformed request line: {}".format(request_line))
                method = request_line_parts[0].upper()
                path = request_line_parts[1]

                headers = {}
                for line in header_lines[1:]:
                    header_parts = line.split(':', 1)
                    if len(header_parts) == 2:
                        headers[header_parts[0].strip().lower()] = header_parts[1].strip()

                # --- Read Request Body (if Content-Length specified) ---
                content_length = int(headers.get('content-length', 0))
                body = body_start # Include any part of the body received with headers
                
                # Read remaining body bytes based on Content-Length
                while len(body) < content_length:
                    bytes_to_read = min(4096, content_length - len(body))
                    try:
                        chunk = conn.recv(bytes_to_read)
                        if not chunk:
                            raise IOError("Connection closed unexpectedly while reading body")
                        body += chunk
                    except socket.timeout:
                        raise socket.timeout("Timeout reading request body")
                    except Exception as body_err:
                         raise ValueError("Error reading body: {}".format(body_err))
                
                sc.sticky["last_request_len"] = len(body) # Log actual body length read

                # --- Process Request ---
                response = handle_request(method, headers, body) # Pass parsed parts
                conn.sendall(response)

            except socket.timeout:
                 error_msg = "Socket timeout during connection handling with {}".format(addr if addr else 'unknown')
                 sc.sticky["server_thread_error"] = error_msg
                 # Try sending timeout response if possible
                 try:
                     timeout_response = "HTTP/1.1 408 Request Timeout\r\nContent-Length: 0\r\nConnection: close\r\n\r\n"
                     if conn: conn.sendall(timeout_response)
                 except: pass # Ignore errors sending timeout response
            except Exception as e:
                tb_str = traceback.format_exc()
                error_msg = "Error handling connection from {}: {}\n{}".format(addr if addr else 'unknown', e, tb_str)
                sc.sticky["server_thread_error"] = error_msg
                # Try sending internal server error response
                try:
                    error_response_body = json.dumps({"status": "error", "result": "Internal server error during connection handling."})
                    error_response = "HTTP/1.1 500 Internal Server Error\r\nContent-Type: application/json\r\nContent-Length: {}\r\nAccess-Control-Allow-Origin: *\r\nConnection: close\r\n\r\n{}".format(len(error_response_body), error_response_body)
                    if conn: conn.sendall(error_response)
                except Exception as send_err:
                    sc.sticky["server_thread_error"] = str(sc.sticky.get("server_thread_error", "")) + "\nAdditionally failed to send error response: {}".format(send_err)
            finally:
                if conn:
                    conn.close()

        # End of while loop (server stopping)
        sc.sticky["server_status"] = "Server stopped."

    except Exception as e:
        tb_str = traceback.format_exc()
        error_msg = "FATAL: Socket server thread failed: {}\n{}".format(e, tb_str)
        sc.sticky["server_thread_error"] = error_msg
        sc.sticky["server_status"] = "Server stopped due to error."
    finally:
        if server_socket:
            server_socket.close()
        current_status = sc.sticky.get("server_status", "")
        if "listening" in current_status: # Update only if it thought it was running
            sc.sticky["server_status"] = "Server stopped."


# --- HTTP Server Logic ---

def handle_request(method, headers, body):
    """
    Handles parsed HTTP request components (method, headers, body).
    Handles CORS preflight (OPTIONS) and processes POST commands.
    Returns the HTTP response string.
    """
    response_body = ""
    try:
        # --- Handle OPTIONS Preflight Request ---
        if method == "OPTIONS":
            # Send CORS preflight response
            cors_headers = {
                "Access-Control-Allow-Origin": "*", # Or specify origin for tighter security
                "Access-Control-Allow-Methods": "POST, OPTIONS",
                "Access-Control-Allow-Headers": "Content-Type",
                "Access-Control-Max-Age": "86400",
                "Content-Length": "0"
            }
            response_lines = ["HTTP/1.1 200 OK"]
            for key, value in cors_headers.items():
                response_lines.append("{}: {}".format(key, value))
            response_lines.append("Connection: close")
            response = "\r\n".join(response_lines) + "\r\n\r\n"
            sc.sticky["server_status"] = "Handled OPTIONS request"
            return response

        # --- Handle POST Request ---
        elif method == "POST":
            # Ensure content type is JSON if body exists
            content_type = headers.get('content-type', '').lower()
            if body and 'application/json' not in content_type:
                 raise ValueError("Invalid Content-Type for POST: '{}'. Expected 'application/json'.".format(content_type))

            if not body:
                 raise ValueError("No body found in POST request")

            json_body_str = body.strip('\x00').strip()
            if not json_body_str:
                raise ValueError("Empty body after stripping in POST request")

            try:
                command_data = json.loads(json_body_str)
            except ValueError as json_e:
                 raise ValueError("Invalid JSON received: {} - Body start: '{}...'".format(json_e, json_body_str[:100]))

            result = process_command(command_data) # process_command handles its own errors via sticky
            response_body = json.dumps(result, cls=GHEncoder) # Use GHEncoder
            status_line = "HTTP/1.1 200 OK"

            post_headers = {
                 "Content-Type": "application/json",
                 "Content-Length": str(len(response_body)),
                 "Access-Control-Allow-Origin": "*",
                 "Connection": "close"
             }
            response_lines = [status_line]
            for key, value in post_headers.items():
                response_lines.append("{}: {}".format(key, value))

            response = "\r\n".join(response_lines) + "\r\n\r\n" + response_body
            return response

        # --- Handle Other Methods ---
        else:
             raise ValueError("Unsupported HTTP method: {}".format(method))

    except Exception as e:
        tb_str = traceback.format_exc()
        error_msg = "Error processing request (Method: {}): {}\n{}".format(method, e, tb_str)
        sc.sticky["request_processing_error"] = error_msg # Log error

        # Prepare error response
        result = {"status": "error", "result": "Server error processing request. Check GH component output."}
        response_body = json.dumps(result)
        error_status = "HTTP/1.1 500 Internal Server Error" if not isinstance(e, ValueError) else "HTTP/1.1 400 Bad Request"
        error_headers = {
            "Content-Type": "application/json",
            "Content-Length": str(len(response_body)),
            "Access-Control-Allow-Origin": "*", # Allow CORS for error response too
            "Connection": "close"
        }
        response_lines = [error_status]
        for key, value in error_headers.items():
            response_lines.append("{}: {}".format(key, value))

        response = "\r\n".join(response_lines) + "\r\n\r\n" + response_body
        return response


# Modify process_command to avoid printing errors directly
def process_command(command_data):
    """Process a command and return the result dictionary. Uses sticky for errors."""
    command_type = command_data.get("type")
    # Clear previous processing errors before starting
    sc.sticky.pop("processing_error", None)
    sc.sticky.pop("last_error", None) # Clear specific update error too

    try:
        if command_type == "get_selected_script_component":
            # Execute on UI thread
            action = Action(lambda: sc.sticky.update({"__temp_result": get_selected_script_component_details()}))
            Rhino.RhinoApp.InvokeOnUiThread(action)
            # Check if the action itself failed to put anything in sticky (might happen if UI thread is blocked/crashes instantly)
            if "__temp_result" not in sc.sticky:
                 raise RuntimeError("UI thread action for get_selected_script_component did not complete or store result.")
            result = sc.sticky.pop("__temp_result", {"status": "error", "result": "UI thread execution failed for get_selected"})
            return result

        elif command_type == "update_script":
            instance_guid = command_data.get("instance_guid")
            code = command_data.get("code")
            description = command_data.get("description")
            param_definitions = command_data.get("param_definitions")

            if not instance_guid:
                 # Log error to sticky
                 sc.sticky["processing_error"] = "Missing 'instance_guid' for update_script."
                 return {"status": "error", "result": "Missing 'instance_guid'."}

            # Execute the update on the UI thread
            action = Action(lambda: sc.sticky.update({"__temp_result": update_script_component_on_ui_thread(instance_guid, code, description, param_definitions)}))
            Rhino.RhinoApp.InvokeOnUiThread(action)
            # Check if the action itself failed to put anything in sticky
            if "__temp_result" not in sc.sticky:
                 raise RuntimeError("UI thread action for update_script did not complete or store result.")
            result = sc.sticky.pop("__temp_result", {"status": "error", "result": "UI thread execution failed for update"})

            # Check for specific error logged during the update by update_script_component_on_ui_thread
            last_err = sc.sticky.get("last_error")
            if last_err and result.get("status") == "error":
                 result["result"] = "{}; Specific Error: {}".format(result.get("result", "Update error"), last_err)
            elif last_err:
                 result["warning"] = "Update success with issues: {}".format(last_err)

            return result

        else:
             # Log error to sticky
             sc.sticky["processing_error"] = "Unknown command type: {}".format(command_type)
             return {"status": "error", "result": "Unknown command type: {}".format(command_type)}

    # --- MODIFIED EXCEPTION HANDLING ---
    except Exception as e:
         tb_str = traceback.format_exc()
         # Log full traceback to sticky (for GH component bubble)
         error_msg_full = "Error in process_command ({}): {}\n{}".format(command_type, e, tb_str)
         sc.sticky["processing_error"] = error_msg_full

         # Create a more informative error message for the web app response
         error_detail_for_web = "Failed during '{}': {}".format(command_type, str(e))
         # Optionally add first line of traceback? Be cautious with length.
         # tb_lines = tb_str.splitlines()
         # if len(tb_lines) > 0: error_detail_for_web += " ({})".format(tb_lines[-1].strip())

         return {"status": "error", "result": error_detail_for_web} # Return specific error message
    # --- END MODIFIED EXCEPTION HANDLING ---


# --- Main Script Logic (runs in GHPython component) ---

# === Required Input: Add a boolean input named 'RunServer' to your component ===
# Default its value to True if you want the server to start automatically.
run_server_toggle = locals().get("RunServer", False) # Read the input, default to False if not connected

# === State Management using sc.sticky ===
server_was_intended_to_run = sc.sticky.get("server_is_intended_to_run", False)
server_thread_active = sc.sticky.get("socket_server_started", False) # Checks if thread object was created

# --- Start/Stop Logic ---
if run_server_toggle and not server_was_intended_to_run:
    # --- START SERVER ---
    # Check if a thread might still exist but wasn't flagged (e.g., after script reload)
    old_thread = sc.sticky.get("server_thread_obj")
    if old_thread and old_thread.isAlive():
         print("Warning: Previous server thread might still be active. Attempting to signal stop first.")
         sc.sticky["run_server"] = False # Signal old thread to stop
         time.sleep(1.2) # Give it a moment to potentially stop

    print("Toggle ON: Starting socket server thread...")
    try:
        # Ensure sticky is clean before start
        sc.sticky.pop("server_thread_error", None)
        sc.sticky.pop("request_processing_error", None)
        sc.sticky.pop("processing_error", None)
        sc.sticky.pop("last_error", None)
        sc.sticky.pop("server_status", None) # Clear old status

        sc.sticky["run_server"] = True # Flag for the thread loop
        thread = threading.Thread(target=socket_server_thread)
        thread.daemon = True
        thread.start()
        sc.sticky["socket_server_started"] = True # Mark thread object as created
        sc.sticky["server_thread_obj"] = thread # Store the thread object itself
        sc.sticky["server_is_intended_to_run"] = True # Mark desired state

        # Allow brief moment for server thread to update status
        time.sleep(0.1)
        print("Server thread initiated.")

    except Exception as start_err:
         print("ERROR starting server thread: {}".format(start_err))
         sc.sticky["socket_server_started"] = False
         sc.sticky["server_is_intended_to_run"] = False
         sc.sticky["server_thread_obj"] = None
         sc.sticky["server_status"] = "Failed to start"


elif not run_server_toggle and server_was_intended_to_run:
    # --- STOP SERVER ---
    print("Toggle OFF: Signaling server thread to stop...")
    sc.sticky["run_server"] = False # Signal thread to exit its loop
    sc.sticky["server_is_intended_to_run"] = False # Mark desired state
    # Note: Thread stops itself. We don't explicitly join() here to avoid blocking GH.
    # The thread status will update via sticky["server_status"] when it exits.
    # We keep 'socket_server_started' True until a new thread is started,
    # indicating a thread *was* running, even if stopping. Clear thread object ref.
    sc.sticky["server_thread_obj"] = None


# --- Status Reporting and Error Checking (Runs every time component updates) ---

# Check for errors logged by the background thread(s) and print from main thread
server_error = sc.sticky.pop("server_thread_error", None)
if server_error:
    ghenv.Component.AddRuntimeMessage(Grasshopper.Kernel.GH_RuntimeMessageLevel.Error, "Server Thread Error:\n" + str(server_error)[:500]) # Show in component bubble
    # print("! SERVER THREAD ERROR:\n{}".format(server_error)) # Optional: also print to Rhino console

req_proc_error = sc.sticky.pop("request_processing_error", None)
if req_proc_error:
    ghenv.Component.AddRuntimeMessage(Grasshopper.Kernel.GH_RuntimeMessageLevel.Warning, "Request Handling Error:\n" + str(req_proc_error)[:500])
    # print("! REQUEST PROCESSING ERROR:\n{}".format(req_proc_error))

cmd_proc_error = sc.sticky.pop("processing_error", None)
if cmd_proc_error:
    ghenv.Component.AddRuntimeMessage(Grasshopper.Kernel.GH_RuntimeMessageLevel.Warning, "Command Processing Error:\n" + str(cmd_proc_error)[:500])
    # print("! COMMAND PROCESSING ERROR:\n{}".format(cmd_proc_error))

# Get current status from sticky (updated by the server thread)
server_status_message = sc.sticky.get("server_status", "Server Off")

# Display current status
# Use component message bubble for primary status feedback
ghenv.Component.Message = server_status_message

# Optional: Set component nickname based on status
if "listening" in server_status_message.lower():
    ghenv.Component.NickName = COMPONENT_NICKNAME + " (Running)"
elif "error" in server_status_message.lower():
     ghenv.Component.NickName = COMPONENT_NICKNAME + " (Error)"
else:
    ghenv.Component.NickName = COMPONENT_NICKNAME + " (Stopped)"


# Optional: Output the status string to an output parameter named 'status'
# status = server_status_message

# --- Debug Output ---
# === Required Output: Add a text output named 'debug_output' to your component ===
debug_info_list = ["--- sc.sticky contents ({}) ---".format(time.strftime("%H:%M:%S"))]

# --- CORRECTED CHECK ---
# Check if the 'sc' module has the 'sticky' attribute and if it's dictionary-like
if hasattr(sc, "sticky"):
    try:
        # Create a sorted list of items for consistent order
        # Use items() for Python 2.7 compatibility with IronPython
        sticky_items = sc.sticky.items() # Get items first
        sorted_items = sorted(sticky_items)

        if not sorted_items:
            debug_info_list.append("(sticky is empty)")

        for key, value in sorted_items:
             # Avoid printing the raw thread object, show relevant info instead
             if key == "server_thread_obj" and isinstance(value, threading.Thread):
                 thread_state = "Alive" if value.isAlive() else "Not Alive"
                 value_str = "<Thread ID: {}, State: {}>".format(value.ident, thread_state)
             else:
                 # Convert value to string representation and truncate if too long
                 try:
                     value_str = repr(value) # Use repr for clearer type info
                 except Exception as repr_err:
                      value_str = "[Error getting repr: {}]".format(repr_err)

                 if len(value_str) > 200: # Limit length for readability
                     value_str = value_str[:200] + "..."

             debug_info_list.append(u"{}: {}".format(key, value_str)) # Use unicode literals

    except AttributeError:
         # Catch if sc.sticky is not dict-like (e.g., None) after hasattr check passes
         debug_info_list.append("(sc.sticky exists but is not dictionary-like)")
    except Exception as debug_err:
        debug_info_list.append("! Error reading sticky: {}".format(debug_err))
else:
    debug_info_list.append("(Attribute 'sticky' not found on 'sc')")
# --- END CORRECTED CHECK ---

# Assign the formatted string list joined by newlines to the debug_output variable.
# Grasshopper will automatically pass this to the output parameter named 'debug_output'.
debug_output = "\n".join(debug_info_list)
# ---------- end vibecode_gh_server_running ----------
ghpython_script_10 = GhPythonScript()  # -> out, debug_output
# ---------- ghpython_script_10: Python ----------
__author__ = "Joo"
# IronPython 2.7
import scriptcontext as sc
import clr
import socket
import threading
import json
import System
from System import Guid
from System.Drawing import RectangleF
import traceback # To log detailed errors
import time # Ensure time is imported
import re # Add import for regular expressions
import Rhino
# Add References
clr.AddReference("System")
clr.AddReference("System.Drawing")
clr.AddReference("Grasshopper")

# Imports for Grasshopper types
import Grasshopper
import Grasshopper as gh
from Grasshopper.Kernel import GH_ParamAccess
from Grasshopper.Kernel.Parameters import (
    Param_GenericObject, Param_String, Param_Number,
    Param_Integer, Param_Boolean, Param_Guid, Param_Point,
    Param_Vector, Param_Curve, Param_Surface, Param_Brep, Param_Mesh
)
# Import Action for Rhino.RhinoApp.InvokeOnUiThread
from System import Action

debug_info_list = ["--- sc.sticky contents ({}) ---".format(time.strftime("%H:%M:%S"))]
debug_info_list = ["--- sc.sticky contents ({}) ---".format(time.strftime("%H:%M:%S"))]

# --- CORRECTED CHECK ---
# Check if the 'sc' module has the 'sticky' attribute and if it's dictionary-like
if hasattr(sc, "sticky"):
    try:
        # Create a sorted list of items for consistent order
        # Use items() for Python 2.7 compatibility with IronPython
        sticky_items = sc.sticky.items() # Get items first
        sorted_items = sorted(sticky_items)

        if not sorted_items:
            debug_info_list.append("(sticky is empty)")

        for key, value in sorted_items:
             # Avoid printing the raw thread object, show relevant info instead
             if key == "server_thread_obj" and isinstance(value, threading.Thread):
                 thread_state = "Alive" if value.isAlive() else "Not Alive"
                 value_str = "<Thread ID: {}, State: {}>".format(value.ident, thread_state)
             else:
                 # Convert value to string representation and truncate if too long
                 try:
                     value_str = repr(value) # Use repr for clearer type info
                 except Exception as repr_err:
                      value_str = "[Error getting repr: {}]".format(repr_err)

                 if len(value_str) > 200: # Limit length for readability
                     value_str = value_str[:200] + "..."

             debug_info_list.append(u"{}: {}".format(key, value_str)) # Use unicode literals

    except AttributeError:
         # Catch if sc.sticky is not dict-like (e.g., None) after hasattr check passes
         debug_info_list.append("(sc.sticky exists but is not dictionary-like)")
    except Exception as debug_err:
        debug_info_list.append("! Error reading sticky: {}".format(debug_err))
else:
    debug_info_list.append("(Attribute 'sticky' not found on 'sc')")
# --- END CORRECTED CHECK ---

# Assign the formatted string list joined by newlines to the debug_output variable.
# Grasshopper will automatically pass this to the output parameter named 'debug_output'.
debug_output = "\n".join(debug_info_list)
# ---------- end ghpython_script_10 ----------
panel_8 = Panel(ghpython_script_10.debug_output)
